# Dynamo graph 01A_interface_single_selection_final.dyn (Dynamo 0.7.3.3034)

select_model_element = DSModelElementSelection()  # 1 picked in the model
string = StringInput("Base Offset")
select_model_element_2 = DSModelElementSelection()  # 1 picked in the model
getParameterValueByName = Element.GetParameterValueByName(select_model_element_2, string)
setParameterByName = Element.SetParameterByName(select_model_element, string, getParameterValueByName)
