# Dynamo graph 01B_interface_multi_selection_final.dyn (Dynamo 0.7.5.3272)

select_model_elements = DSModelElementsSelection()  # 7 picked in the model
string = StringInput("Base Offset")
select_model_element = DSModelElementSelection()  # 1 picked in the model
getParameterValueByName = Element.GetParameterValueByName(select_model_element, string)
setParameterByName = Element.SetParameterByName(select_model_elements, string, getParameterValueByName)
