# Dynamo graph 02A_interface_type_selection.dyn (Dynamo 0.7.3.3034)

placeable_family_types = FamilyTypes("Concrete-Square-Column:30 x 30")
all_instances_of_placeable = ElementsOfFamilyType(placeable_family_types)  # "All instances of Placeable Family Type"
string = StringInput("Base Offset")
system_family_types = ElementTypes("Wall")
all_instances_of_system_family = ElementsOfType(system_family_types)  # "All Instances of System Family Type"
getParameterValueByName = Element.GetParameterValueByName(all_instances_of_system_family, string)
setParameterByName = Element.SetParameterByName(all_instances_of_placeable, string, getParameterValueByName, lacing=CrossProduct)
