# Dynamo graph 02B_interface_wall_type_selection.dyn (Dynamo 0.7.3.3034)

select_model_elements = DSModelElementsSelection()  # 7 picked in the model
string = StringInput("Base Offset")
wall_types = WallTypes("8\" CONC WALL")
getParameterValueByName = Element.GetParameterValueByName(wall_types, string)
setParameterByName = Element.SetParameterByName(select_model_elements, string, getParameterValueByName)
watch = Watch(wall_types)
