# Dynamo graph 03_interface_cat_selection.dyn (Dynamo 0.7.3.3034)

categories = Categories("StructuralColumns")
all_instances_of_category = ElementsOfCategory(categories)
string = StringInput("Base Offset")
system_family_types = ElementTypes("Wall")
all_instances_of_system_family = ElementsOfType(system_family_types)  # "All Instances of System Family Type"
getParameterValueByName = Element.GetParameterValueByName(all_instances_of_system_family, string)
setParameterByName = Element.SetParameterByName(all_instances_of_category, string, getParameterValueByName, lacing=CrossProduct)
