# Dynamo graph Add Another Level Above Existing Upper Story Level.dyn (Dynamo 1.2.0.2566)

element_types = ElementTypes("Level")
all_elements_of_type = ElementsOfType(element_types)
watch = Watch(all_elements_of_type)
elevation = Level.Elevation(watch)
sort = List.Sort(elevation)
code_block = CodeBlock { false; }
sortIndexByValue = SortIndexByValue(sort, code_block)
reorder = Reorder(sort, sortIndexByValue)
code_block_2 = CodeBlock(x=reorder) { x[0]; x[1]; }
sub = code_block_2.out0 - code_block_2.out1
add = code_block_2.out0 + sub
byElevation = Level.ByElevation(add)
