# Dynamo graph Armadillo - Architectural panels Unfolding.dyn (Dynamo 0.9.0.3067)

# group: Input
select_face = DSFaceSelection()
# note: Number of panels along the arc (u)
integer_slider = IntegerSlider(9, range=2..50 step 2)
# note: Number of panels in longitudinal direction (v)
integer_slider_2 = IntegerSlider(14, range=2..80 step 2)
family_types = FamilyTypes("Roof Panel:Roof Panel")
code_block = CodeBlock { "Panel thickness"; }
# note: Calculate the offset from the surface, which is equal to the panel thickness
getParameterValueByName = Element.GetParameterValueByName(element=family_types, parameterName=code_block)

# group: Surface division
code_block_2 = CodeBlock(u=integer_slider, v=integer_slider_2) { 0..1..#u+1; 0..1..#v+1; }
pointAtParameter = Surface.PointAtParameter(surface=select_face, u=code_block_2.out0, v=code_block_2.out1, lacing=CrossProduct)
normalAtPoint = Surface.NormalAtPoint(surface=select_face, point=pointAtParameter, lacing=Longest)
# note: Divide the surface in multiple parts in U and V direction and translate the result with a distance equal to the panel thickness.
translate = Geometry.Translate(geometry=pointAtParameter, direction=normalAtPoint, distance=getParameterValueByName)
flatten = Flatten(translate)

watch = Watch(flatten)

# group: Ordering and grouping points for panel creation
code_block_3 = CodeBlock(v=integer_slider_2) { {0,v+1,v+2,1}; }
code_block_4 = CodeBlock { 1; }
# note: Make sublists of 4 points, to be used as locations points for the adaptive panels
sublists = List.Sublists(list=flatten, ranges=code_block_3, offset=code_block_4)
code_block_5 = CodeBlock(v=integer_slider_2) { v+1; }
# note: Drop each (v+1)-th group, to avoid overlap
dropEveryNthItem = List.DropEveryNthItem(list=sublists, n=code_block_5)
count = List.Count()
code_block_6 = CodeBlock { 4; }
eq = _ == code_block_6
compose = ComposeFunctions(count, eq)  # "Function.Compose"
# note: Only take the valid groups with 4 points
filter = List.Filter(dropEveryNthItem, compose)

watch_2 = Watch(sublists)
watch_3 = Watch(dropEveryNthItem)

# group: Unfolding the curved surface
# note: Surface generation within Dynamo, as visual check
byPerimeterPoints = Surface.ByPerimeterPoints(filter)
flipNormalDirection = Surface.FlipNormalDirection(byPerimeterPoints)
unfoldListOfSurfaces_AndReturnTransforms = DynamoUnfold.Unfolding.UnfoldListOfSurfaces_AndReturnTransforms(flipNormalDirection)
code_block_7 = CodeBlock { 140000; 750; }
packUnfoldedSurfaces = DynamoUnfold.Unfolding.PackUnfoldedSurfaces(unfoldListOfSurfaces_AndReturnTransforms.out1, code_block_7.out0, code_block_7.out0, code_block_7.out1)
code_block_8 = CodeBlock { 1000; }
generateUnfoldedLabels = DynamoUnfold.Unfolding.GenerateUnfoldedLabels(packUnfoldedSurfaces.out1, code_block_8)
generateInitialLabels = DynamoUnfold.Unfolding.GenerateInitialLabels(packUnfoldedSurfaces.out1, code_block_8)

# group: Fabrication panel creation 2D
perimeterCurves = Surface.PerimeterCurves(packUnfoldedSurfaces.out0)
startPoint = Curve.StartPoint(perimeterCurves)
code_block_9 = CodeBlock { 1; }
flatten_2 = List.Flatten(list=startPoint, amt=code_block_9)
family_types_2 = FamilyTypes("Fabrication Panel:Fabrication Panel")
byPoints = AdaptiveComponent.ByPoints(flatten_2, family_types_2)

# group: Roof panel creation 3D
family_types_3 = FamilyTypes("Roof Panel:Roof Panel")
byPoints_2 = AdaptiveComponent.ByPoints(filter, family_types_3)

# group: Adding Mark values to the panels
flatten_3 = Flatten(byPoints)
code_block_10 = CodeBlock { "Mark"; }
code_block_11 = CodeBlock(lst=flatten_3) { 0..List.Count(lst)-1; }
string_from_object = FromObject(code_block_11)
setParameterByName = Element.SetParameterByName(element=flatten_3, parameterName=code_block_10, value=string_from_object)
flatten_4 = Flatten(byPoints_2)
setParameterByName_2 = Element.SetParameterByName(element=flatten_4, parameterName=code_block_10, value=string_from_object)
