# Dynamo graph Armadillo Platform - Structural Model.dyn (Dynamo 0.9.0.3067)

# group: INPUT PARAMETERS
# note: Column Height (distance between floor and top chord end of first truss)
number_slider = DoubleSlider(8000, range=8..20000 step 100)
select_face = DSFaceSelection()  # 1 picked in the model
# note: Number of trusses
integer_slider = IntegerSlider(18, range=2..30 step 2)
code_block = CodeBlock(v=integer_slider) { 0..1..#v; }
# note: Truss height
number_slider_2 = DoubleSlider(1600, range=1.6..3500 step 50)
# note: Truss width
number_slider_3 = DoubleSlider(1500, range=1.5..3500 step 50)
# note: Arc Discretization
integer_slider_2 = IntegerSlider(14, range=2..30 step 2)
code_block_2 = CodeBlock(u=integer_slider_2) { 0..1..#u; }
# note: Column Truss Division
integer_slider_3 = IntegerSlider(7, range=3..9 step 2)

# group: MAIN TRUSS CHORDS
code_block_3 = CodeBlock { 0; }
# note: Top Chords
byIsoCurveOnSurface = Curve.ByIsoCurveOnSurface(baseSurface=select_face, direction=code_block_3, parameter=code_block, lacing=Longest)
offset = Curve.Offset(curve=byIsoCurveOnSurface, distance=number_slider_2)
# note: Lower Chord Central Reference Lines
code_block_4 = CodeBlock(lst=offset, w=number_slider_3)
# ---------- code_block_4.designscript (10 lines) ----------
//Discretize the list of lower chords of trusses
EdgeChords={List.FirstItem(lst),List.LastItem(lst)};
//Remove first and last item from the list
//These are the reference lines for the lower chords
//of the inner trusses
n=List.Count(lst)-1;
InnerChordRef=List.RemoveItemAtIndex(lst,{0,n});
//Define horizontal translation of InnerChord references
InnerChordsA=InnerChordRef.Translate(Vector.XAxis(),0.5*w);
InnerChordsB=InnerChordRef.Translate(Vector.XAxis(),-0.5*w);
# ----------------------------------------
join = List.Join(code_block_4.EdgeChords, code_block_4.InnerChordsA, code_block_4.InnerChordsB)

# group: POINT GENERATION ON TRUSS ELEMENTS
# note: Division of Bottom Chords of Edge Trusses
pointAtParameter = Curve.PointAtParameter(curve=code_block_4.EdgeChords, param=code_block_2, lacing=CrossProduct)
# note: Division of Top Chords
pointAtParameter_2 = Curve.PointAtParameter(curve=byIsoCurveOnSurface, param=code_block_2, lacing=CrossProduct)
code_block_5 = CodeBlock(lst=pointAtParameter_2)
# ---------- code_block_5.designscript (5 lines) ----------
//Discretize the list in first, last and rest
EdgesChordPoints={List.FirstItem(lst),List.LastItem(lst)};
//Remove first and last item in the list
n=List.Count(lst)-1;
InnerChordPoints=List.RemoveItemAtIndex(lst,{0,n});
# ----------------------------------------
# note: Division of Bottom Chords A of Middle Trusses
pointAtParameter_3 = Curve.PointAtParameter(curve=code_block_4.InnerChordsA, param=code_block_2, lacing=CrossProduct)
# note: Division of Bottom Chords B of Middle Trusses
pointAtParameter_4 = Curve.PointAtParameter(curve=code_block_4.InnerChordsB, param=code_block_2, lacing=CrossProduct)

# group: VERTICALS & DIAGONALS EDGE TRUSSES
# note: Verticals of edge trusses
byStartPointEndPoint = Line.ByStartPointEndPoint(startPoint=pointAtParameter, endPoint=code_block_5.EdgesChordPoints, lacing=Longest)
# note: Diagonals of edge trusses
v_bracings = Custom[V bracings](PointsList_Curve1=code_block_5.EdgesChordPoints, PointsList_Curve2=pointAtParameter)  # Generate V bracing lines between two equal collections of points.
join_2 = List.Join(byStartPointEndPoint, v_bracings)

# group: DIAGONAL CONNECTORS INNER TRUSSES
# note: Diagonal connectors between bottom truss chord A and top truss chord
byStartPointEndPoint_2 = Line.ByStartPointEndPoint(startPoint=pointAtParameter_3, endPoint=code_block_5.InnerChordPoints)
# note: Horizontal connectors between bottom chords of middle triangular trusses
byStartPointEndPoint_3 = Line.ByStartPointEndPoint(startPoint=pointAtParameter_3, endPoint=pointAtParameter_4)
# note: Diagonal connectors between bottom truss chord B and top truss chord
byStartPointEndPoint_4 = Line.ByStartPointEndPoint(startPoint=pointAtParameter_4, endPoint=code_block_5.InnerChordPoints)
# note: Diagonals between top chord and bottom chord A
v_bracings_2 = Custom[V bracings](PointsList_Curve1=pointAtParameter_3, PointsList_Curve2=code_block_5.InnerChordPoints)
# note: Diagonals between top chord and bottom chord B
v_bracings_3 = Custom[V bracings](PointsList_Curve1=pointAtParameter_4, PointsList_Curve2=code_block_5.InnerChordPoints)
# note: Diagonals between bottom chord A and bottom chord B
v_bracings_4 = Custom[V bracings](PointsList_Curve1=pointAtParameter_3, PointsList_Curve2=pointAtParameter_4)
join_3 = List.Join(byStartPointEndPoint_2, byStartPointEndPoint_3, byStartPointEndPoint_3, byStartPointEndPoint_4, v_bracings_2, v_bracings_3, v_bracings_4)

# group: ROOF WINDBRACINGS
code_block_6 = CodeBlock(lst=pointAtParameter_2)
# ---------- code_block_6.designscript (6 lines) ----------
//Index of last item in the list
n=List.Count(lst)-1;
FirstItem={lst[0]};
SecondItem={lst[1]};
PenultItem={lst[n-1]};
LastItem={lst[n]};
# ----------------------------------------
v_bracings_5 = Custom[V bracings](PointsList_Curve1=code_block_6.FirstItem, PointsList_Curve2=code_block_6.SecondItem)
v_bracings_6 = Custom[V bracings](PointsList_Curve1=code_block_6.PenultItem, PointsList_Curve2=code_block_6.LastItem)
join_4 = List.Join(v_bracings_5, v_bracings_6)

# group: ROOF STRUT BEAMS
transpose = List.Transpose(pointAtParameter_2)
chained_line = Custom[Chained line](ConsecutivePoints=transpose)  # Returns a chain of lines based on the input of consecutive points

# group: POSITIONING OF THE COLUMN BASE GRIDS
# note: Column height is driven by the indicated base level
levels = Levels("Level 0F")
elevation = Level.Elevation(levels)
byCoordinates = Point.ByCoordinates(z=elevation)
ZAxis = Vector.ZAxis()
byOriginNormal = Plane.ByOriginNormal(origin=byCoordinates, normal=ZAxis)
# note: Create placeholder lines for column ends
pullOntoPlane = Curve.PullOntoPlane(curve=offset, plane=byOriginNormal)

# group: DEFINITION OF END POINTS OF SLANTED COLUMNS
startPoint = Curve.StartPoint(pullOntoPlane)
startPoint_2 = Curve.StartPoint(byIsoCurveOnSurface)
endPoint = Curve.EndPoint(pullOntoPlane)
endPoint_2 = Curve.EndPoint(byIsoCurveOnSurface)
# note: Connection base points of the columns
code_block_7 = CodeBlock(lst=startPoint)
# ---------- code_block_7.designscript (5 lines) ----------
//Discretize the list in first, last and rest
EdgeBasePoints={List.FirstItem(lst),List.LastItem(lst)};
//Remove first and last item in the list
n=List.Count(lst)-1;
InnerBasePoints=List.RemoveItemAtIndex(lst,{0,n});
# ----------------------------------------
# note: Connection top points of the columns
startPoint_3 = Curve.StartPoint(code_block_4.EdgeChords)
code_block_8 = CodeBlock(lst=endPoint)  # same code as code_block_7
endPoint_3 = Curve.EndPoint(code_block_4.EdgeChords)
create = List.Create(code_block_4.InnerChordsA, code_block_4.InnerChordsB)
transpose_2 = List.Transpose(create)
startPoint_4 = Curve.StartPoint(transpose_2)
endPoint_4 = Curve.EndPoint(transpose_2)

# group: MAIN COLUMN LINES
# note: Outer columns Y+
byStartPointEndPoint_5 = Line.ByStartPointEndPoint(startPoint=startPoint, endPoint=startPoint_2, lacing=Longest)
# note: Outer columns Y-
byStartPointEndPoint_6 = Line.ByStartPointEndPoint(startPoint=endPoint, endPoint=endPoint_2, lacing=Longest)
join_5 = List.Join(byStartPointEndPoint_5, byStartPointEndPoint_6)
flatten = Flatten(join_5)
# note: Slanted columns
# note: Inner Edge columns Y+
byStartPointEndPoint_7 = Line.ByStartPointEndPoint(startPoint=code_block_7.EdgeBasePoints, endPoint=startPoint_3, lacing=Longest)
# note: Inner Edge columns Y-
byStartPointEndPoint_8 = Line.ByStartPointEndPoint(startPoint=code_block_8.EdgeBasePoints, endPoint=endPoint_3, lacing=Longest)
byStartPointEndPoint_9 = Line.ByStartPointEndPoint()
# note: Inner Middle columns Y+
combine = List.Combine(byStartPointEndPoint_9, code_block_7.InnerBasePoints, startPoint_4)
byStartPointEndPoint_10 = Line.ByStartPointEndPoint()
# note: Inner Middle columns Y-
combine_2 = List.Combine(byStartPointEndPoint_10, code_block_8.InnerBasePoints, endPoint_4)
join_6 = List.Join(byStartPointEndPoint_7, byStartPointEndPoint_8, combine, combine_2)
flatten_2 = Flatten(join_6)

# group: DEFINITION OF CONNECTION POINTS OF COLUMN BRACINGS
code_block_9 = CodeBlock(ColumnDivision=integer_slider_3) { ColumnDivision; }
code_block_10 = CodeBlock(z=code_block_9) { 0..1..#z; }
code_block_11 = CodeBlock { 0; }
removeItemAtIndex = List.RemoveItemAtIndex(list=code_block_10, indices=code_block_11)
pointAtParameter_5 = Curve.PointAtParameter(curve=byStartPointEndPoint_7, param=removeItemAtIndex, lacing=CrossProduct)
pointAtParameter_6 = Curve.PointAtParameter(curve=byStartPointEndPoint_5, param=removeItemAtIndex, lacing=CrossProduct)
code_block_12 = CodeBlock(lst=pointAtParameter_6)
# ---------- code_block_12.designscript (5 lines) ----------
//Discretize the list in first, last and rest
FirstLast={List.FirstItem(lst),List.LastItem(lst)};
//Remove first and last item in the list
n=List.Count(lst)-1;
Mid=List.RemoveItemAtIndex(lst,{0,n});
# ----------------------------------------
pointAtParameter_7 = Curve.PointAtParameter(curve=byStartPointEndPoint_8, param=removeItemAtIndex, lacing=CrossProduct)
pointAtParameter_8 = Curve.PointAtParameter(curve=byStartPointEndPoint_6, param=removeItemAtIndex, lacing=CrossProduct)
code_block_13 = CodeBlock(lst=pointAtParameter_8)  # same code as code_block_12
firstItem = List.FirstItem()
map = List.Map(list=combine, f_x=firstItem)
pointAtParameter_9 = Curve.PointAtParameter(curve=map, param=removeItemAtIndex, lacing=CrossProduct)
lastItem = List.LastItem()
map_2 = List.Map(list=combine, f_x=lastItem)
pointAtParameter_10 = Curve.PointAtParameter(curve=map_2, param=removeItemAtIndex, lacing=CrossProduct)
firstItem_2 = List.FirstItem()
map_3 = List.Map(list=combine_2, f_x=firstItem_2)
pointAtParameter_11 = Curve.PointAtParameter(curve=map_3, param=removeItemAtIndex, lacing=CrossProduct)
lastItem_2 = List.LastItem()
map_4 = List.Map(list=combine_2, f_x=lastItem_2)
pointAtParameter_12 = Curve.PointAtParameter(curve=map_4, param=removeItemAtIndex, lacing=CrossProduct)

# group: COLUMN BRACINGS
v_bracings_7 = Custom[V bracings](PointsList_Curve1=pointAtParameter_5, PointsList_Curve2=code_block_12.FirstLast)
v_bracings_8 = Custom[V bracings](PointsList_Curve1=pointAtParameter_7, PointsList_Curve2=code_block_13.FirstLast)
v_bracings_9 = Custom[V bracings](PointsList_Curve1=code_block_12.Mid, PointsList_Curve2=pointAtParameter_9)
v_bracings_10 = Custom[V bracings](PointsList_Curve1=code_block_12.Mid, PointsList_Curve2=pointAtParameter_10)
v_bracings_11 = Custom[V bracings](PointsList_Curve1=code_block_13.Mid, PointsList_Curve2=pointAtParameter_11)
v_bracings_12 = Custom[V bracings](PointsList_Curve1=code_block_13.Mid, PointsList_Curve2=pointAtParameter_12)
v_bracings_13 = Custom[V bracings](PointsList_Curve1=pointAtParameter_9, PointsList_Curve2=pointAtParameter_10)
v_bracings_14 = Custom[V bracings](PointsList_Curve1=pointAtParameter_11, PointsList_Curve2=pointAtParameter_12)
join_7 = List.Join(v_bracings_7, v_bracings_8, v_bracings_9, v_bracings_10, v_bracings_11, v_bracings_12, v_bracings_13, v_bracings_14)
flatten_3 = Flatten(join_7)

create_2 = List.Create(byIsoCurveOnSurface, join, join_2, join_3, join_4, chained_line, flatten, flatten_2, flatten_3)

# group: REVIT: MODEL STRUCTURAL COLUMNS & STRUCTURAL FRAMINGS & STRUCTURAL FOUNDATIONS
# note: The order which is applied for the creation of the elements is really important. This to guarantuee a good connection of the structural elements. First columns, then primary beams, then secondary beams, bracings. The Structural Foundations are created after the columns are placed.
code_block_14 = CodeBlock(lst=create_2)
# ---------- code_block_14.designscript (14 lines) ----------
//Outer & Inner columns
lst[6..7];
//Top & Bottom Chords
lst[0..1];
//Roof Strut Beams
lst[5];
//Roof Windbracings
lst[4];
//Verticals & Diagonals of trusses
lst[2..3];
//Column diagonals
lst[8];
//Column Base Points for foundation design.
BP=lst[6].StartPoint;
# ----------------------------------------
flatten_4 = Flatten(code_block_14.out0)
levels_2 = Levels("Level 0F")
structural_column_types = StructuralColumnTypes("CHS 244.5x6")
columnByCurve = StructuralFraming.ColumnByCurve(curve=flatten_4, level=levels_2, structuralColumnType=structural_column_types)
flatten_5 = Flatten(code_block_14.out1)
levels_3 = Levels("Level 3S")
structural_framing_types = StructuralFramingTypes("CHS 244.5x6")
beamByCurve = StructuralFraming.BeamByCurve(curve=flatten_5, level=levels_3, structuralFramingType=structural_framing_types)
flatten_6 = Flatten(code_block_14.out2)
levels_4 = Levels("Level 3S")
structural_framing_types_2 = StructuralFramingTypes("CHS 159x8")
beamByCurve_2 = StructuralFraming.BeamByCurve(curve=flatten_6, level=levels_4, structuralFramingType=structural_framing_types_2)
flatten_7 = Flatten(code_block_14.out3)
levels_5 = Levels("Level 3S")
structural_framing_types_3 = StructuralFramingTypes("CHS 114.3x6")
braceByCurve = StructuralFraming.BraceByCurve(flatten_7, levels_5, structural_framing_types_3)
flatten_8 = Flatten(code_block_14.out4)
levels_6 = Levels("Level 3S")
structural_framing_types_4 = StructuralFramingTypes("CHS 114.3x6")
braceByCurve_2 = StructuralFraming.BraceByCurve(flatten_8, levels_6, structural_framing_types_4)
flatten_9 = Flatten(code_block_14.out5)
levels_7 = Levels("Level 0F")
structural_framing_types_5 = StructuralFramingTypes("CHS 114.3x6")
braceByCurve_3 = StructuralFraming.BraceByCurve(flatten_9, levels_7, structural_framing_types_5)
join_8 = List.Join(columnByCurve, beamByCurve, beamByCurve_2, braceByCurve, braceByCurve_2, braceByCurve_3)
flatten_10 = Flatten(join_8)
code_block_15 = CodeBlock { "Structural Material"; }
code_block_16 = CodeBlock { "Steel, S 235"; }
byName = Material.ByName(code_block_16)
setParameterByName = Element.SetParameterByName(element=flatten_10, parameterName=code_block_15, value=byName)
code_block_17 = CodeBlock { "Pile Cap-4 Round Pile"; "Standard"; }
byFamilyNameAndTypeName = FamilyType.ByFamilyNameAndTypeName(code_block_17.out0, code_block_17.out1)
byPoint = FamilyInstance.ByPoint(familyType=byFamilyNameAndTypeName, point=code_block_14.BP)
code_block_18 = CodeBlock { "Structural Material"; }
code_block_19 = CodeBlock { "Concrete, CIP, C30/37"; }
byName_2 = Material.ByName(code_block_19)
setParameterByName_2 = Element.SetParameterByName(element=byPoint, parameterName=code_block_18, value=byName_2)

# group: DISPLAY COLOR OF DYNAMO GEOMETRY
code_block_20 = CodeBlock(lst=create_2)
# ---------- code_block_20.designscript (12 lines) ----------
//Outer & Inner columns
lst[6..7];
//Top & Bottom Chords
lst[0..1];
//Roof Strut Beams
lst[5];
//Roof Windbracings
lst[4];
//Verticals & Diagonals of trusses
lst[2..3];
//Column diagonals
lst[8];
# ----------------------------------------
code_block_21 = CodeBlock { 0; 0; 255; 0; }
byARGB = Color.ByARGB(a=code_block_21.out0, r=code_block_21.out1, g=code_block_21.out2, b=code_block_21.out3)
byGeometryColor = Display.Display.ByGeometryColor(code_block_20.out1, byARGB)
code_block_22 = CodeBlock { 0; 0; 0; 255; }
byARGB_2 = Color.ByARGB(a=code_block_22.out0, r=code_block_22.out1, g=code_block_22.out2, b=code_block_22.out3)
byGeometryColor_2 = Display.Display.ByGeometryColor(code_block_20.out2, byARGB_2)
code_block_23 = CodeBlock { 0; 255; 128; 0; }
byARGB_3 = Color.ByARGB(a=code_block_23.out0, r=code_block_23.out1, g=code_block_23.out2, b=code_block_23.out3)
byGeometryColor_3 = Display.Display.ByGeometryColor(code_block_20.out3, byARGB_3)
code_block_24 = CodeBlock { 0; 255; 0; 255; }
byARGB_4 = Color.ByARGB(a=code_block_24.out0, r=code_block_24.out1, g=code_block_24.out2, b=code_block_24.out3)
byGeometryColor_4 = Display.Display.ByGeometryColor(code_block_20.out4, byARGB_4)
code_block_25 = CodeBlock { 0; 0; 255; 255; }
byARGB_5 = Color.ByARGB(a=code_block_25.out0, r=code_block_25.out1, g=code_block_25.out2, b=code_block_25.out3)
byGeometryColor_5 = Display.Display.ByGeometryColor(code_block_20.out5, byARGB_5)
code_block_26 = CodeBlock { 0; 255; 0; 0; }
byARGB_6 = Color.ByARGB(a=code_block_26.out0, r=code_block_26.out1, g=code_block_26.out2, b=code_block_26.out3)
byGeometryColor_6 = Display.Display.ByGeometryColor(code_block_20.out0, byARGB_6)
