# Dynamo graph COW_FINAL.dyn (Dynamo 0.7.1.13837)

code_block = CodeBlock()
# ---------- code_block.designscript (268 lines) ----------
//EYE BALL
sphere_center_point=Point.ByCoordinates(-1.854,-0.228,3.856);
sphereradius=0.096;
eyeball=Sphere.ByCenterPointRadius(sphere_center_point,sphereradius);

//HORNS
//POINTS, CURVES AND SURFACES FOR HORNS
p1=Point.ByCoordinates(-1.402,-0.350,4.294);
circle1=Circle.ByCenterPointRadiusNormal(p1,0.12,Vector.ByCoordinates(0,1,0));

p2=Point.ByCoordinates(-1.509,-0.485,4.298);
circle2=Circle.ByCenterPointRadiusNormal(p2,0.097,Vector.ByCoordinates(0,0.903,-0.429));

p3=Point.ByCoordinates(-1.537,-0.668,4.370);
circle3=Circle.ByCenterPointRadiusNormal(p3,0.074,Vector.ByCoordinates(0,-0.554,0.832));

p4=Point.ByCoordinates(-1.640,-0.775,4.582);
circle4=Circle.ByCenterPointRadiusNormal(p4,0.056,Vector.ByCoordinates(0,0,1));

p5=Point.ByCoordinates(-1.718,-0.816,4.779);
circle5=Circle.ByCenterPointRadiusNormal(p5,0.012,Vector.ByCoordinates(0,0.388,0.921));

cc1={circle1,circle2,circle3,circle4,circle5};
horn=Surface.ByLoft(cc1);

//FRONTLEG
//POINTS FOR FRONTLEG
a [0]= { 0.020041523 , 0.101793014 , 0.15813675 , 0.223938836 , 0.330511121 , 0.466649331 , 0.600592102 , 0.728501557 , 0.853945237 , 0.981479114 , 1.11574408 };
a [1]= { 0.200732763 , 0.152735932 , 0.176710686 , 0.239916842 , 0.32417698 , 0.419701085 , 0.516483264 , 0.618203526 , 0.686084039 , 0.648304509 , 0.69804053 };
a [2]= { 0.62290592 , 0.61040953 , 0.618976183 , 0.559041915 , 0.479957408 , 0.401225853 , 0.329091648 , 0.273166706 , 0.228939845 , 0.241495559 , 0.318230785 };
a [3]= { 0.33359711 , 0.273744188 , 0.245159247 , 0.278028562 , 0.331750527 , 0.397051291 , 0.468153885 , 0.534430075 , 0.584134063 , 0.62049472 , 0.585235306 };
a [4]= { 0.591492436 , 0.619570142 , 0.577203139 , 0.522935516 , 0.460391755 , 0.386078102 , 0.317744953 , 0.271899949 , 0.238111919 , 0.259440545 , 0.30548119 };
a [5]= { 0.365618397 , 0.33096754 , 0.306816173 , 0.338208921 , 0.379418824 , 0.42529851 , 0.476477627 , 0.52426482 , 0.563633982 , 0.566009467 , 0.53041636 };
a [6]= { 0.338483465 , 0.308825419 , 0.30381278 , 0.318202347 , 0.352702644 , 0.398950232 , 0.444794277 , 0.488331472 , 0.52612983 , 0.538456461 , 0.516759312 };
a [7]= { 0.269854284 , 0.224859762 , 0.219601313 , 0.243222723 , 0.302309813 , 0.367799125 , 0.436196126 , 0.480753621 , 0.514294643 , 0.508635302 , 0.465138118 };
a [8]= { 0.198940311 , 0.151801894 , 0.146010429 , 0.17537461 , 0.231142302 , 0.305354073 , 0.370315094 , 0.4251912 , 0.457300863 , 0.430507056 , 0.370197908 };
a [9]= { 0.178106978 , 0.130968561 , 0.125177096 , 0.154541277 , 0.210308969 , 0.284520739 , 0.34948176 , 0.404357866 , 0.43646753 , 0.409673722 , 0.349364574 };
a1=a;
b [0]= { -0.348275212 , -0.447552816 , -0.576327273 , -0.692519453 , -0.757729723 , -0.777572774 , -0.778349487 , -0.755465931 , -0.712982163 , -0.680044748 , -0.687955469 };
b [1]= { -0.385792894 , -0.473126514 , -0.568604828 , -0.645615126 , -0.696755782 , -0.72480724 , -0.734789697 , -0.720262345 , -0.661076831 , -0.564114393 , -0.47661002 };
b [2]= { -0.475645873 , -0.553515511 , -0.631949749 , -0.681867353 , -0.67684378 , -0.672866952 , -0.640710427 , -0.585099663 , -0.5195659 , -0.441935583 , -0.423323339 };
b [3]= { -0.428327279 , -0.467678168 , -0.531264902 , -0.594886711 , -0.641029651 , -0.668156988 , -0.662730168 , -0.638258819 , -0.587293035 , -0.526930655 , -0.4641449 };
b [4]= { -0.460312009 , -0.529569465 , -0.590471513 , -0.641098755 , -0.681175448 , -0.683713582 , -0.654555434 , -0.596079385 , -0.530027644 , -0.458735683 , -0.400347776 };
b [5]= { -0.446472775 , -0.483733783 , -0.531043616 , -0.57047537 , -0.601329819 , -0.624831707 , -0.620661504 , -0.601525315 , -0.567324009 , -0.516812343 , -0.479458811 };
b [6]= { -0.446880728 , -0.484178351 , -0.531462984 , -0.576845099 , -0.609586105 , -0.620891019 , -0.608187616 , -0.589017555 , -0.559884419 , -0.514145003 , -0.471783697 };
b [7]= { -0.42605857 , -0.474029015 , -0.541190905 , -0.6038227 , -0.635833259 , -0.645278671 , -0.639697603 , -0.594734994 , -0.536164567 , -0.473316641 , -0.42240148 };
b [8]= { -0.422046109 , -0.480490319 , -0.555464042 , -0.624618404 , -0.675049109 , -0.686520824 , -0.648553162 , -0.597223928 , -0.529316585 , -0.459021394 , -0.414255995 };
b [9]= { -0.422046109 , -0.480490319 , -0.555464042 , -0.624618404 , -0.675049109 , -0.686520824 , -0.648553162 , -0.597223928 , -0.529316585 , -0.459021394 , -0.414255995 };
b1=b;
c [0]= { 2.049947181 , 2.049947181 , 2.049947181 , 2.049947181 , 2.049947181 , 2.049947181 , 2.049947181 , 2.049947181 , 2.049947181 , 2.049947181 , 2.049947181 };
c [1]= { 1.639957745 , 1.639957745 , 1.639957745 , 1.639957745 , 1.639957745 , 1.639957745 , 1.639957745 , 1.639957745 , 1.639957745 , 1.639957745 , 1.639957745 };
c [2]= { 1.434963027 , 1.434963027 , 1.434963027 , 1.434963027 , 1.434963027 , 1.434963027 , 1.434963027 , 1.434963027 , 1.434963027 , 1.434963027 , 1.434963027 };
c [3]= { 1.229968309 , 1.229968309 , 1.229968309 , 1.229968309 , 1.229968309 , 1.229968309 , 1.229968309 , 1.229968309 , 1.229968309 , 1.229968309 , 1.229968309 };
c [4]= { 1.02497359 , 1.02497359 , 1.02497359 , 1.02497359 , 1.02497359 , 1.02497359 , 1.02497359 , 1.02497359 , 1.02497359 , 1.02497359 , 1.02497359 };
c [5]= { 0.819978872 , 0.819978872 , 0.819978872 , 0.819978872 , 0.819978872 , 0.819978872 , 0.819978872 , 0.819978872 , 0.819978872 , 0.819978872 , 0.819978872 };
c [6]= { 0.614984154 , 0.614984154 , 0.614984154 , 0.614984154 , 0.614984154 , 0.614984154 , 0.614984154 , 0.614984154 , 0.614984154 , 0.614984154 , 0.614984154 };
c [7]= { 0.409989436 , 0.409989438 , 0.409989441 , 0.409989368 , 0.409988881 , 0.40999268 , 0.410030306 , 0.409982297 , 0.40998961 , 0.409989433 , 0.409989436 };
c [8]= { 0.204994718 , 0.204994718 , 0.204994718 , 0.204994718 , 0.204994718 , 0.204994718 , 0.204994718 , 0.204994718 , 0.204994718 , 0.204994718 , 0.204994718 };
c [9]= { 0 , 0 , 0 , 0 , 0 , 0 , 0 , 0 , 0 , 0 , 0 };
c1=c;
pointfrontleg=Point.ByCoordinates(a1,b1,c1);
//CURVES AND SURFACE FOR FRONTLEG
curvesfrontleg=NurbsCurve.ByPoints(pointfrontleg);
surfacefrontleg=Surface.ByLoft(curvesfrontleg);

//POINTS FOR TORSO
x [0]= { 4.809322524 , 4.774373797 , 4.74785128 , 4.728919149 , 4.716753356 , 4.712468862 , 4.721194261 , 4.744190304 , 4.775747247 , 4.811690019 , 4.850421292 , 4.889635074 , 4.926278525 , 4.958453534 , 4.984891577 , 5.001653469 , 5.003979063 , 4.992720389 , 4.97126621 , 4.943017525 };
x [1]= { 4.809322524 , 4.774393955 , 4.747867734 , 4.728923035 , 4.716750763 , 4.712475832 , 4.721227302 , 4.744254186 , 4.775818553 , 4.811735711 , 4.850422684 , 4.889590993 , 4.926206128 , 4.958378238 , 4.984838647 , 5.001632763 , 5.003977393 , 4.99272248 , 4.971265819 , 4.943017525 };
x [2]= { 4.982744448 , 5.026754402 , 5.057918823 , 5.07382614 , 5.072098839 , 5.053557186 , 5.024748707 , 4.991044381 , 4.955308291 , 4.918486306 , 4.87968177 , 4.84031408 , 4.804013132 , 4.773652798 , 4.75165878 , 4.741997388 , 4.74853467 , 4.768466385 , 4.796216795 , 4.826201208 };
x [3]= { 4.873232248 , 4.842050583 , 4.817448249 , 4.801694131 , 4.797049577 , 4.80423981 , 4.82060577 , 4.844071734 , 4.874292239 , 4.909057984 , 4.943577272 , 4.975668161 , 5.005806602 , 5.032931302 , 5.05445907 , 5.0655352 , 5.060741022 , 5.041723601 , 5.013555031 , 4.981329628 };
x [4]= { 4.871833981 , 4.847268176 , 4.833204182 , 4.828146982 , 4.830603704 , 4.839347627 , 4.853667936 , 4.872638889 , 4.894910953 , 4.918867908 , 4.942631998 , 4.964536932 , 4.983077206 , 4.996141085 , 5.00149874 , 4.99979702 , 4.993077334 , 4.982366624 , 4.968272254 , 4.951400357 };
x [5]= { 4.855287046 , 4.82275226 , 4.799134175 , 4.784975609 , 4.780818965 , 4.787141357 , 4.804254277 , 4.830618748 , 4.861862323 , 4.89501068 , 4.929077615 , 4.9624495 , 4.992811434 , 5.01846652 , 5.038065675 , 5.04843768 , 5.045790769 , 5.030530006 , 5.005104043 , 4.971974996 };
x [6]= { 4.788668967 , 4.741843387 , 4.705739911 , 4.686460775 , 4.690072869 , 4.717462432 , 4.758980856 , 4.806378966 , 4.855380647 , 4.904418301 , 4.95463128 , 5.00413021 , 5.0480675 , 5.08450118 , 5.113051811 , 5.124592913 , 5.106983105 , 5.066334204 , 5.017068995 , 4.973651505 };
x [7]= { 4.693562031 , 4.652046248 , 4.6203886 , 4.604098378 , 4.608651585 , 4.634663114 , 4.672886804 , 4.715820026 , 4.760133806 , 4.804768588 , 4.85077731 , 4.896115987 , 4.935865136 , 4.968028953 , 4.992396905 , 5.003416471 , 4.993670368 , 4.965948084 , 4.927752649 , 4.88661202 };
x [8]= { 4.104499769 , 4.112961667 , 4.200705883 , 4.29129803 , 4.335544148 , 4.313641251 , 4.32634311 , 4.391636474 , 4.488807473 , 4.586662495 , 4.685493831 , 4.779624615 , 4.869067654 , 4.897302861 , 4.9014297 , 4.835762725 , 4.738911144 , 4.663109726 , 4.709068928 , 4.757591838 };
x [9]= { 3.984935758 , 3.98451363 , 4.020402437 , 4.118774352 , 4.201987276 , 4.253293218 , 4.276190048 , 4.342511661 , 4.443139187 , 4.541876953 , 4.641124426 , 4.740735611 , 4.835124333 , 4.919989451 , 4.941846817 , 4.938844439 , 4.876252527 , 4.77661397 , 4.768170152 , 4.806660115 };
x [10]= { 3.893891508 , 3.883587144 , 3.948568308 , 4.03336502 , 4.124956017 , 4.199813795 , 4.233149644 , 4.312197875 , 4.414553335 , 4.516255166 , 4.618661813 , 4.720977169 , 4.822862354 , 4.921317267 , 4.97540798 , 4.987368113 , 4.959384861 , 4.878718785 , 4.801089912 , 4.810308011 };
x [11]= { 3.802818318 , 3.826400763 , 3.886702955 , 3.971431923 , 4.070896155 , 4.154715259 , 4.198918681 , 4.301251161 , 4.404823284 , 4.511326684 , 4.618674015 , 4.727165831 , 4.833806237 , 4.941148606 , 5.014833803 , 5.035240093 , 5.01677733 , 4.946174049 , 4.850591927 , 4.814200921 };
x [12]= { 4.81143311 , 4.901658116 , 5.003938092 , 5.07472793 , 5.087329868 , 5.06746915 , 4.977418035 , 4.861221468 , 4.747003566 , 4.631500322 , 4.516314447 , 4.402692962 , 4.290967877 , 4.181012461 , 4.094360792 , 4.014533926 , 3.90587944 , 3.811578591 , 3.740292461 , 3.719511502 };
x [13]= { 5.043243737 , 5.101770368 , 5.141483061 , 5.170013004 , 5.126346573 , 5.031828986 , 4.919113327 , 4.804108005 , 4.688960659 , 4.573051217 , 4.457389264 , 4.343714426 , 4.231539824 , 4.124396409 , 4.028717655 , 3.935004628 , 3.830974676 , 3.736669325 , 3.670870701 , 3.645584985 };
x [14]= { 3.514107202 , 3.540892962 , 3.610147758 , 3.704020696 , 3.797095212 , 3.895785331 , 4.000418037 , 4.105736395 , 4.217924224 , 4.333604489 , 4.45039383 , 4.566548794 , 4.681997297 , 4.79690208 , 4.913797226 , 5.016302602 , 5.069734306 , 5.089124772 , 5.096963694 , 5.142675482 };
x [15]= { 3.449045603 , 3.477788428 , 3.544574354 , 3.635018382 , 3.71966065 , 3.822346272 , 3.923709309 , 4.026071735 , 4.133712857 , 4.248252316 , 4.361546018 , 4.473862859 , 4.587007544 , 4.699259013 , 4.812566031 , 4.916455869 , 4.981218307 , 5.001634563 , 5.019312113 , 5.075897685 };
x [16]= { 3.370287837 , 3.397457202 , 3.467256839 , 3.553747525 , 3.629071969 , 3.730611177 , 3.829570844 , 3.928572647 , 4.030898961 , 4.142474739 , 4.25126784 , 4.359815774 , 4.46963601 , 4.578605629 , 4.686781936 , 4.793715599 , 4.857043899 , 4.887810266 , 4.921211484 , 4.962963802 };
x [17]= { 3.258474663 , 3.286002299 , 3.343828986 , 3.429556973 , 3.518303125 , 3.61141595 , 3.708256379 , 3.807611539 , 3.910524869 , 4.017668366 , 4.123414596 , 4.228281855 , 4.335339566 , 4.441604425 , 4.547193022 , 4.6502663 , 4.721548137 , 4.758750908 , 4.793939878 , 4.853348626 };
x [18]= { 3.153100003 , 3.181880876 , 3.232746795 , 3.310871681 , 3.398911737 , 3.494438073 , 3.590480515 , 3.687918987 , 3.786845455 , 3.889996661 , 3.993003839 , 4.094626905 , 4.197033881 , 4.300082734 , 4.402484384 , 4.50086285 , 4.574692698 , 4.614481538 , 4.652067676 , 4.691624803 };
x [19]= { 3.062762661 , 3.085993653 , 3.130143265 , 3.204710343 , 3.285129412 , 3.37637691 , 3.473247581 , 3.565888773 , 3.659921261 , 3.757725645 , 3.855839101 , 3.953704028 , 4.051232808 , 4.148934415 , 4.246359971 , 4.342558742 , 4.410205784 , 4.458026859 , 4.491769038 , 4.509139659 };
x [20]= { 2.984215549 , 3.000550778 , 3.03829775 , 3.108114306 , 3.180077642 , 3.265757366 , 3.356857576 , 3.44786753 , 3.538315188 , 3.630424322 , 3.722638185 , 3.8155514 , 3.905762289 , 3.996649251 , 4.088295058 , 4.180512412 , 4.249710889 , 4.291086228 , 4.315620344 , 4.328801802 };
x [21]= { 2.910098022 , 2.924911356 , 2.954123912 , 3.01893921 , 3.084013813 , 3.161530455 , 3.245671272 , 3.33060485 , 3.415894487 , 3.5019997 , 3.587750359 , 3.674649782 , 3.755642437 , 3.837442061 , 3.922999067 , 4.007803567 , 4.081468864 , 4.117955524 , 4.13535029 , 4.142350395 };
x [22]= { 2.840877143 , 2.842526445 , 2.882329815 , 2.938377423 , 2.997317576 , 3.065452465 , 3.142219032 , 3.220196164 , 3.298806284 , 3.377910046 , 3.45682579 , 3.536225681 , 3.612687782 , 3.683392204 , 3.759607403 , 3.837456835 , 3.907628622 , 3.949284694 , 3.957212036 , 3.962938982 };
x [23]= { 2.776238935 , 2.779624404 , 2.811921313 , 2.859492704 , 2.912387915 , 2.971803465 , 3.039231955 , 3.109386399 , 3.180520455 , 3.251737565 , 3.322995206 , 3.394280549 , 3.464961391 , 3.529802906 , 3.592751545 , 3.66216713 , 3.721873671 , 3.767241597 , 3.773443794 , 3.776879389 };
x [24]= { 2.714165669 , 2.720279757 , 2.744690734 , 2.784045034 , 2.832111224 , 2.883631344 , 2.942762027 , 3.005169095 , 3.069210505 , 3.133072654 , 3.197107154 , 3.260865358 , 3.325425574 , 3.383683502 , 3.439721736 , 3.493567265 , 3.547653694 , 3.589217413 , 3.599306023 , 3.612651848 };
x [25]= { 2.654387211 , 2.661623985 , 2.68094359 , 2.713827446 , 2.756802992 , 2.802548753 , 2.854634038 , 2.90957344 , 2.96714188 , 3.024216182 , 3.081519208 , 3.138561717 , 3.1965646 , 3.248727591 , 3.298825543 , 3.346406126 , 3.383420575 , 3.421333674 , 3.441832129 , 3.453803855 };
x [26]= { 2.596662165 , 2.602658581 , 2.619950237 , 2.648318769 , 2.684852756 , 2.725988423 , 2.772732838 , 2.82105314 , 2.872122828 , 2.92284142 , 2.973739026 , 3.024429859 , 3.075987924 , 3.122554467 , 3.167088054 , 3.20795087 , 3.240675941 , 3.266930095 , 3.289320514 , 3.299763953 };
x [27]= { 2.540773625 , 2.546528975 , 2.56134109 , 2.585157343 , 2.616376504 , 2.65333891 , 2.694180101 , 2.736148398 , 2.780401406 , 2.824851845 , 2.869392464 , 2.91383039 , 2.958907811 , 2.999918599 , 3.038708092 , 3.073433397 , 3.097244137 , 3.118999998 , 3.141706272 , 3.150157638 };
x [28]= { 2.48725284 , 2.493676665 , 2.505496264 , 2.525644139 , 2.552114593 , 2.583941796 , 2.618584825 , 2.654412061 , 2.691990064 , 2.729897653 , 2.76800519 , 2.8059844 , 2.844626986 , 2.879356429 , 2.912868682 , 2.938815101 , 2.957301139 , 2.97571604 , 2.994737503 , 3.005149033 };
x [29]= { 2.4361387 , 2.441425314 , 2.450842772 , 2.467537302 , 2.489620889 , 2.51658728 , 2.545110938 , 2.575199649 , 2.606314676 , 2.637655258 , 2.669507087 , 2.701146449 , 2.733408552 , 2.762139579 , 2.789967845 , 2.812127762 , 2.826529816 , 2.840143509 , 2.853939855 , 2.864516651 };
x [30]= { 2.385563088 , 2.389790406 , 2.397397026 , 2.410348977 , 2.428159336 , 2.450084977 , 2.472749293 , 2.497043251 , 2.521935287 , 2.546924986 , 2.57239081 , 2.59780511 , 2.623617228 , 2.646532004 , 2.668906382 , 2.686620752 , 2.698146109 , 2.70909141 , 2.719645961 , 2.726800382 };
x [31]= { 2.335415045 , 2.33858887 , 2.344372766 , 2.353813915 , 2.367274644 , 2.383979178 , 2.400884425 , 2.419265055 , 2.438015138 , 2.456701748 , 2.475669917 , 2.494879231 , 2.51411972 , 2.531301389 , 2.54821461 , 2.561499835 , 2.570240122 , 2.577965957 , 2.585515005 , 2.590430269 };
x [32]= { 2.285587225 , 2.287706474 , 2.291618015 , 2.297770502 , 2.306860496 , 2.318148948 , 2.329442106 , 2.341719179 , 2.354264938 , 2.366769654 , 2.379348644 , 2.392195823 , 2.404790304 , 2.416294711 , 2.427725188 , 2.436639306 , 2.442113097 , 2.447065478 , 2.452139089 , 2.454981592 };
x [33]= { 2.236022807 , 2.237035709 , 2.239011319 , 2.242018036 , 2.246679748 , 2.252330297 , 2.257985991 , 2.264093924 , 2.270380981 , 2.27665125 , 2.282893094 , 2.289245519 , 2.295514266 , 2.301261693 , 2.30709972 , 2.311538756 , 2.314200922 , 2.316669801 , 2.319226208 , 2.320404602 };
x [34]= { 2.186475376 , 2.186475376 , 2.186475376 , 2.186475376 , 2.186475376 , 2.186475376 , 2.186475376 , 2.186475376 , 2.186475376 , 2.186475376 , 2.186475376 , 2.186475376 , 2.186475376 , 2.186475376 , 2.186475376 , 2.186475376 , 2.186475376 , 2.186475376 , 2.186475376 , 2.186475376 };
x [35]= { 1.981480658 , 1.981480658 , 1.981480658 , 1.981480658 , 1.981480658 , 1.981480658 , 1.981480658 , 1.981480658 , 1.981480658 , 1.981480658 , 1.981480658 , 1.981480658 , 1.981480658 , 1.981480658 , 1.981480658 , 1.981480658 , 1.981480658 , 1.981480658 , 1.981480658 , 1.981480658 };
x [36]= { 1.77648594 , 1.77648594 , 1.77648594 , 1.77648594 , 1.77648594 , 1.77648594 , 1.77648594 , 1.77648594 , 1.77648594 , 1.77648594 , 1.77648594 , 1.77648594 , 1.77648594 , 1.77648594 , 1.77648594 , 1.77648594 , 1.77648594 , 1.77648594 , 1.77648594 , 1.77648594 };
x [37]= { 1.571491222 , 1.571491222 , 1.571491222 , 1.571491222 , 1.571491222 , 1.571491222 , 1.571491222 , 1.571491222 , 1.571491222 , 1.571491222 , 1.571491222 , 1.571491222 , 1.571491222 , 1.571491222 , 1.571491222 , 1.571491222 , 1.571491222 , 1.571491222 , 1.571491222 , 1.571491222 };
x [38]= { 1.366496504 , 1.366496504 , 1.366496504 , 1.366496504 , 1.366496504 , 1.366496504 , 1.366496504 , 1.366496504 , 1.366496504 , 1.366496504 , 1.366496504 , 1.366496504 , 1.366496504 , 1.366496504 , 1.366496504 , 1.366496504 , 1.366496504 , 1.366496504 , 1.366496504 , 1.366496504 };
x [39]= { 1.161501786 , 1.161501786 , 1.161501786 , 1.161501786 , 1.161501786 , 1.161501786 , 1.161501786 , 1.161501786 , 1.161501786 , 1.161501786 , 1.161501786 , 1.161501786 , 1.161501786 , 1.161501786 , 1.161501786 , 1.161501786 , 1.161501786 , 1.161501786 , 1.161501786 , 1.161501786 };
x [40]= { 0.956507068 , 0.956507068 , 0.956507068 , 0.956507068 , 0.956507068 , 0.956507068 , 0.956507068 , 0.956507068 , 0.956507068 , 0.956507068 , 0.956507068 , 0.956507068 , 0.956507068 , 0.956507068 , 0.956507068 , 0.956507068 , 0.956507068 , 0.956507068 , 0.956507068 , 0.956507068 };
x [41]= { 0.751512349 , 0.751512349 , 0.751512349 , 0.751512349 , 0.751512349 , 0.751512349 , 0.751512349 , 0.751512349 , 0.751512349 , 0.751512349 , 0.751512349 , 0.751512349 , 0.751512349 , 0.751512349 , 0.751512349 , 0.751512349 , 0.751512349 , 0.751512349 , 0.751512349 , 0.751512349 };
x [42]= { 0.546517631 , 0.546517631 , 0.546517631 , 0.546517631 , 0.546517631 , 0.546517631 , 0.546517631 , 0.546517631 , 0.546517631 , 0.546517631 , 0.546517631 , 0.546517631 , 0.546517631 , 0.546517631 , 0.546517631 , 0.546517631 , 0.546517631 , 0.546517631 , 0.546517631 , 0.546517631 };
x [43]= { 0.341522913 , 0.341522913 , 0.341522913 , 0.341522913 , 0.341522913 , 0.341522913 , 0.341522913 , 0.341522913 , 0.341522913 , 0.341522913 , 0.341522913 , 0.341522913 , 0.341522913 , 0.341522913 , 0.341522913 , 0.341522913 , 0.341522913 , 0.341522913 , 0.341522913 , 0.341522913 };
x [44]= { 0.136528195 , 0.136528195 , 0.136528195 , 0.136528195 , 0.136528195 , 0.136528195 , 0.136528195 , 0.136528195 , 0.136528195 , 0.136528195 , 0.136528195 , 0.136528195 , 0.136528195 , 0.136528195 , 0.136528195 , 0.136528195 , 0.136528195 , 0.136528195 , 0.136528195 , 0.136528195 };
x [45]= { -0.068466523 , -0.068466523 , -0.068466523 , -0.068466523 , -0.068466523 , -0.068466523 , -0.068466523 , -0.068466523 , -0.068466523 , -0.068466523 , -0.068466523 , -0.068466523 , -0.068466523 , -0.068466523 , -0.068466523 , -0.068466523 , -0.068466523 , -0.068466523 , -0.068466523 , -0.068466523 };
x [46]= { -0.273461241 , -0.273461241 , -0.273461241 , -0.273461241 , -0.273461241 , -0.273461241 , -0.273461241 , -0.273461241 , -0.273461241 , -0.273461241 , -0.273461241 , -0.273461241 , -0.273461241 , -0.273461241 , -0.273461241 , -0.273461241 , -0.273461241 , -0.273461241 , -0.273461241 , -0.273461241 };
x [47]= { -0.478455959 , -0.478455959 , -0.478455959 , -0.478455959 , -0.478455959 , -0.478455959 , -0.478455959 , -0.478455959 , -0.478455959 , -0.478455959 , -0.478455959 , -0.478455959 , -0.478455959 , -0.478455959 , -0.478455959 , -0.478455959 , -0.478455959 , -0.478455959 , -0.478455959 , -0.478455959 };
x [48]= { -0.683450677 , -0.683450677 , -0.683450677 , -0.683450677 , -0.683450677 , -0.683450677 , -0.683450677 , -0.683450677 , -0.683450677 , -0.683450677 , -0.683450677 , -0.683450677 , -0.683450677 , -0.683450677 , -0.683450677 , -0.683450677 , -0.683450677 , -0.683450677 , -0.683450677 , -0.683450677 };
x [49]= { -0.888445395 , -0.888445395 , -0.888445395 , -0.888445395 , -0.888445395 , -0.888445395 , -0.888445395 , -0.888445395 , -0.888445395 , -0.888445395 , -0.888445395 , -0.888445395 , -0.888445395 , -0.888445395 , -0.888445395 , -0.888445395 , -0.888445395 , -0.888445395 , -0.888445395 , -0.888445395 };
x [50]= { -1.093440113 , -1.093440113 , -1.093440113 , -1.093440113 , -1.093440113 , -1.093440113 , -1.093440113 , -1.093440113 , -1.093440113 , -1.093440113 , -1.093440113 , -1.093440113 , -1.093440113 , -1.093440113 , -1.093440113 , -1.093440113 , -1.093440113 , -1.093440113 , -1.093440113 , -1.093440113 };
x [51]= { -1.298434832 , -1.298434832 , -1.298434832 , -1.298434832 , -1.298434832 , -1.298434832 , -1.298434832 , -1.298434832 , -1.298434832 , -1.298434832 , -1.298434832 , -1.298434832 , -1.298434832 , -1.298434832 , -1.298434832 , -1.298434832 , -1.298434832 , -1.298434832 , -1.298434832 , -1.298434832 };
x [52]= { -1.50342955 , -1.50342955 , -1.50342955 , -1.50342955 , -1.50342955 , -1.50342955 , -1.50342955 , -1.50342955 , -1.50342955 , -1.50342955 , -1.50342955 , -1.50342955 , -1.50342955 , -1.50342955 , -1.50342955 , -1.50342955 , -1.50342955 , -1.50342955 , -1.50342955 , -1.50342955 };
x [53]= { -1.708424268 , -1.708424268 , -1.708424268 , -1.708424268 , -1.708424268 , -1.708424268 , -1.708424268 , -1.708424268 , -1.708424268 , -1.708424268 , -1.708424268 , -1.708424268 , -1.708424268 , -1.708424268 , -1.708424268 , -1.708424268 , -1.708424268 , -1.708424268 , -1.708424268 , -1.708424268 };
x [54]= { -1.913418986 , -1.913418986 , -1.913418986 , -1.913418986 , -1.913418986 , -1.913418986 , -1.913418986 , -1.913418986 , -1.913418986 , -1.913418986 , -1.913418986 , -1.913418986 , -1.913418986 , -1.913418986 , -1.913418986 , -1.913418986 , -1.913418986 , -1.913418986 , -1.913418986 , -1.913418986 };
x [55]= { -2.118413704 , -2.118413704 , -2.118413704 , -2.118413704 , -2.118413704 , -2.118413704 , -2.118413704 , -2.118413704 , -2.118413704 , -2.118413704 , -2.118413704 , -2.118413704 , -2.118413704 , -2.118413704 , -2.118413704 , -2.118413704 , -2.118413704 , -2.118413704 , -2.118413704 , -2.118413704 };
x [56]= { -2.323408422 , -2.323408422 , -2.323408422 , -2.323408422 , -2.323408422 , -2.323408422 , -2.323408422 , -2.323408422 , -2.323408422 , -2.323408422 , -2.323408422 , -2.323408422 , -2.323408422 , -2.323408422 , -2.323408422 , -2.323408422 , -2.323408422 , -2.323408422 , -2.323408422 , -2.323408422 };
x [57]= { -2.52840314 , -2.52840314 , -2.52840314 , -2.52840314 , -2.52840314 , -2.52840314 , -2.52840314 , -2.52840314 , -2.52840314 , -2.52840314 , -2.52840314 , -2.52840314 , -2.52840314 , -2.52840314 , -2.52840314 , -2.52840314 , -2.52840314 , -2.52840314 , -2.52840314 , -2.52840314 };
x [58]= { -2.733397858 , -2.733397858 , -2.733397858 , -2.733397858 , -2.733397858 , -2.733397858 , -2.733397858 , -2.733397858 , -2.733397858 , -2.733397858 , -2.733397858 , -2.733397858 , -2.733397858 , -2.733397858 , -2.733397858 , -2.733397858 , -2.733397858 , -2.733397858 , -2.733397858 , -2.733397858 };
x [59]= { -2.745882438 , -2.745882438 , -2.745882438 , -2.745882438 , -2.745882438 , -2.745882438 , -2.745882438 , -2.745882438 , -2.745882438 , -2.745882438 , -2.745882438 , -2.745882438 , -2.745882438 , -2.745882438 , -2.745882438 , -2.745882438 , -2.745882438 , -2.745882438 , -2.745882438 , -2.745882438 };
x1=x;
y [0]= { -0.5117 , -0.5314 , -0.5592 , -0.5931 , -0.6311 , -0.6706 , -0.7081 , -0.7401 , -0.7645 , -0.7800 , -0.7866 , -0.7837 , -0.7706 , -0.7480 , -0.7180 , -0.6826 , -0.6440 , -0.6057 , -0.5715 , -0.5456 };
y [1]= { -0.5117 , -0.5314 , -0.5592 , -0.5931 , -0.6311 , -0.6707 , -0.7081 , -0.7402 , -0.7645 , -0.7800 , -0.7866 , -0.7837 , -0.7707 , -0.7481 , -0.7181 , -0.6827 , -0.6441 , -0.6057 , -0.5715 , -0.5456 };
y [2]= { -0.5625 , -0.5595 , -0.5820 , -0.6188 , -0.6590 , -0.6943 , -0.7219 , -0.7420 , -0.7589 , -0.7727 , -0.7787 , -0.7741 , -0.7587 , -0.7331 , -0.6992 , -0.6607 , -0.6225 , -0.5872 , -0.5569 , -0.5336 };
y [3]= { -0.5165 , -0.5323 , -0.5581 , -0.5902 , -0.6251 , -0.6597 , -0.6918 , -0.7184 , -0.7352 , -0.7401 , -0.7345 , -0.7210 , -0.7033 , -0.6814 , -0.6527 , -0.6189 , -0.5844 , -0.5535 , -0.5303 , -0.5190 };
y [4]= { -0.5427 , -0.5523 , -0.5714 , -0.5959 , -0.6216 , -0.6451 , -0.6652 , -0.6808 , -0.6908 , -0.6943 , -0.6906 , -0.6799 , -0.6633 , -0.6421 , -0.6178 , -0.5925 , -0.5682 , -0.5458 , -0.5256 , -0.5077 };
y [5]= { -0.4826 , -0.4969 , -0.5227 , -0.5561 , -0.5931 , -0.6296 , -0.6610 , -0.6844 , -0.6998 , -0.7076 , -0.7080 , -0.7007 , -0.6846 , -0.6604 , -0.6296 , -0.5946 , -0.5581 , -0.5247 , -0.4997 , -0.4884 };
y [6]= { -0.4515 , -0.4716 , -0.5137 , -0.5677 , -0.6234 , -0.6716 , -0.7046 , -0.7222 , -0.7343 , -0.7440 , -0.7459 , -0.7357 , -0.7109 , -0.6718 , -0.6211 , -0.5665 , -0.5176 , -0.4785 , -0.4508 , -0.4359 };
y [7]= { -0.4569 , -0.4792 , -0.5217 , -0.5747 , -0.6283 , -0.6740 , -0.7058 , -0.7242 , -0.7377 , -0.7486 , -0.7515 , -0.7418 , -0.7165 , -0.6770 , -0.6282 , -0.5754 , -0.5236 , -0.4777 , -0.4428 , -0.4238 };
y [8]= { 0.0000 , -0.1283 , -0.1868 , -0.2532 , -0.3465 , -0.4811 , -0.6103 , -0.7033 , -0.7360 , -0.7502 , -0.7746 , -0.7523 , -0.6835 , -0.5680 , -0.4309 , -0.3449 , -0.3112 , -0.2249 , -0.1140 , 0.0000 };
y [9]= { 0.0000 , -0.1367 , -0.2606 , -0.2967 , -0.3742 , -0.4872 , -0.6238 , -0.7170 , -0.7474 , -0.7672 , -0.7937 , -0.7937 , -0.7478 , -0.6679 , -0.5433 , -0.4009 , -0.3077 , -0.2517 , -0.1263 , 0.0000 };
y [10]= { 0.0000 , -0.1426 , -0.2563 , -0.3388 , -0.4105 , -0.5021 , -0.6427 , -0.7327 , -0.7641 , -0.7902 , -0.8208 , -0.8125 , -0.7836 , -0.7328 , -0.6132 , -0.4687 , -0.3286 , -0.2405 , -0.1431 , 0.0000 };
y [11]= { 0.0000 , -0.1528 , -0.2833 , -0.3813 , -0.4490 , -0.5404 , -0.6810 , -0.7465 , -0.7896 , -0.8261 , -0.8466 , -0.8257 , -0.7981 , -0.7590 , -0.6503 , -0.4951 , -0.3400 , -0.2237 , -0.1425 , 0.0000 };
y [12]= { 0.0000 , -0.1087 , -0.1936 , -0.3290 , -0.5034 , -0.6724 , -0.7792 , -0.8078 , -0.8386 , -0.8686 , -0.8669 , -0.8231 , -0.7777 , -0.7133 , -0.6025 , -0.4827 , -0.4124 , -0.3104 , -0.1756 , 0.0000 };
y [13]= { 0.0000 , -0.1552 , -0.3251 , -0.4982 , -0.6658 , -0.7705 , -0.8182 , -0.8480 , -0.8765 , -0.9007 , -0.8870 , -0.8441 , -0.7967 , -0.7237 , -0.6220 , -0.5151 , -0.4325 , -0.3277 , -0.1781 , 0.0000 };
y [14]= { 0.0000 , -0.1904 , -0.3478 , -0.4649 , -0.5835 , -0.6885 , -0.7763 , -0.8614 , -0.9171 , -0.9480 , -0.9529 , -0.9276 , -0.8952 , -0.8602 , -0.8326 , -0.7456 , -0.5713 , -0.3781 , -0.1822 , 0.0000 };
y [15]= { 0.0000 , -0.1934 , -0.3549 , -0.4773 , -0.6105 , -0.6999 , -0.7914 , -0.8815 , -0.9447 , -0.9620 , -0.9490 , -0.9104 , -0.8823 , -0.8455 , -0.8142 , -0.7341 , -0.5700 , -0.3736 , -0.1758 , 0.0000 };
y [16]= { 0.0000 , -0.1964 , -0.3532 , -0.4789 , -0.6252 , -0.7097 , -0.7987 , -0.8909 , -0.9609 , -0.9649 , -0.9353 , -0.8979 , -0.8747 , -0.8382 , -0.8021 , -0.7368 , -0.5792 , -0.3817 , -0.1893 , 0.0000 };
y [17]= { 0.0000 , -0.2005 , -0.3747 , -0.5005 , -0.6171 , -0.7208 , -0.8108 , -0.8901 , -0.9495 , -0.9680 , -0.9328 , -0.8888 , -0.8675 , -0.8362 , -0.8002 , -0.7354 , -0.5842 , -0.3885 , -0.1936 , 0.0000 };
y [18]= { 0.0000 , -0.2030 , -0.3862 , -0.5256 , -0.6359 , -0.7184 , -0.7971 , -0.8691 , -0.9314 , -0.9499 , -0.9274 , -0.8858 , -0.8550 , -0.8323 , -0.8015 , -0.7337 , -0.5867 , -0.3919 , -0.1951 , 0.0000 };
y [19]= { 0.0000 , -0.2071 , -0.3958 , -0.5357 , -0.6583 , -0.7346 , -0.7727 , -0.8446 , -0.9082 , -0.9173 , -0.8971 , -0.8770 , -0.8492 , -0.8228 , -0.7994 , -0.7462 , -0.5957 , -0.4089 , -0.2093 , 0.0000 };
y [20]= { 0.0000 , -0.2103 , -0.4032 , -0.5447 , -0.6774 , -0.7584 , -0.7955 , -0.8311 , -0.8783 , -0.8815 , -0.8672 , -0.8793 , -0.8428 , -0.8034 , -0.7800 , -0.7443 , -0.6080 , -0.4164 , -0.2110 , 0.0000 };
y [21]= { 0.0000 , -0.2099 , -0.4076 , -0.5494 , -0.6874 , -0.7795 , -0.8238 , -0.8575 , -0.8825 , -0.8877 , -0.8879 , -0.9013 , -0.8470 , -0.7828 , -0.7571 , -0.7208 , -0.6112 , -0.4201 , -0.2117 , 0.0000 };
y [22]= { 0.0000 , -0.2296 , -0.4040 , -0.5530 , -0.6934 , -0.7989 , -0.8507 , -0.8847 , -0.9041 , -0.9058 , -0.9069 , -0.9179 , -0.8783 , -0.7784 , -0.7336 , -0.6954 , -0.5974 , -0.4195 , -0.2101 , 0.0000 };
y [23]= { 0.0000 , -0.2180 , -0.3979 , -0.5519 , -0.6903 , -0.8035 , -0.8713 , -0.9063 , -0.9214 , -0.9254 , -0.9238 , -0.9341 , -0.9116 , -0.8269 , -0.7289 , -0.6791 , -0.5722 , -0.4102 , -0.2065 , 0.0000 };
y [24]= { 0.0000 , -0.2049 , -0.3935 , -0.5532 , -0.6876 , -0.8068 , -0.8862 , -0.9264 , -0.9354 , -0.9425 , -0.9427 , -0.9481 , -0.9460 , -0.8698 , -0.7701 , -0.6611 , -0.5529 , -0.3982 , -0.1986 , 0.0000 };
y [25]= { 0.0000 , -0.1985 , -0.3915 , -0.5556 , -0.6895 , -0.8092 , -0.8957 , -0.9442 , -0.9494 , -0.9646 , -0.9641 , -0.9626 , -0.9729 , -0.9009 , -0.8012 , -0.6889 , -0.5359 , -0.3841 , -0.1971 , 0.0000 };
y [26]= { 0.0000 , -0.1998 , -0.3905 , -0.5567 , -0.6973 , -0.8138 , -0.8961 , -0.9539 , -0.9658 , -0.9822 , -0.9825 , -0.9794 , -0.9907 , -0.9216 , -0.8213 , -0.7027 , -0.5487 , -0.3768 , -0.1963 , 0.0000 };
y [27]= { 0.0000 , -0.1986 , -0.3875 , -0.5566 , -0.6999 , -0.8108 , -0.8921 , -0.9581 , -0.9835 , -0.9977 , -1.0034 , -0.9998 , -1.0060 , -0.9390 , -0.8377 , -0.7126 , -0.5437 , -0.3689 , -0.1962 , 0.0000 };
y [28]= { 0.0000 , -0.1966 , -0.3861 , -0.5555 , -0.6989 , -0.8084 , -0.8922 , -0.9593 , -0.9942 , -1.0145 , -1.0255 , -1.0206 , -1.0245 , -0.9574 , -0.8568 , -0.7144 , -0.5390 , -0.3646 , -0.1916 , 0.0000 };
y [29]= { 0.0000 , -0.1967 , -0.3869 , -0.5570 , -0.6999 , -0.8063 , -0.8948 , -0.9585 , -1.0020 , -1.0332 , -1.0462 , -1.0415 , -1.0389 , -0.9677 , -0.8663 , -0.7263 , -0.5478 , -0.3678 , -0.1880 , 0.0000 };
y [30]= { 0.0000 , -0.1971 , -0.3877 , -0.5602 , -0.7025 , -0.8061 , -0.8980 , -0.9595 , -1.0051 , -1.0452 , -1.0670 , -1.0654 , -1.0526 , -0.9743 , -0.8740 , -0.7333 , -0.5542 , -0.3738 , -0.1917 , 0.0000 };
y [31]= { 0.0000 , -0.1977 , -0.3887 , -0.5636 , -0.7055 , -0.8062 , -0.9011 , -0.9610 , -1.0058 , -1.0540 , -1.0871 , -1.0896 , -1.0663 , -0.9810 , -0.8825 , -0.7408 , -0.5614 , -0.3781 , -0.1936 , 0.0000 };
y [32]= { 0.0000 , -0.1983 , -0.3897 , -0.5666 , -0.7076 , -0.8056 , -0.9015 , -0.9628 , -1.0081 , -1.0563 , -1.0994 , -1.1159 , -1.0760 , -0.9859 , -0.8913 , -0.7487 , -0.5662 , -0.3808 , -0.1959 , 0.0000 };
y [33]= { 0.0000 , -0.1987 , -0.3902 , -0.5682 , -0.7064 , -0.8041 , -0.9005 , -0.9648 , -1.0101 , -1.0562 , -1.1102 , -1.1255 , -1.0727 , -0.9833 , -0.8945 , -0.7522 , -0.5682 , -0.3825 , -0.1976 , 0.0000 };
y [34]= { 0.0000 , -0.1988 , -0.3901 , -0.5683 , -0.7012 , -0.7977 , -0.8960 , -0.9669 , -1.0117 , -1.0587 , -1.1102 , -1.1251 , -1.0719 , -0.9819 , -0.8887 , -0.7504 , -0.5684 , -0.3827 , -0.1984 , 0.0000 };
y [35]= { 0.0000 , -0.1988 , -0.3869 , -0.5585 , -0.6892 , -0.7804 , -0.8771 , -0.9579 , -1.0192 , -1.0642 , -1.1089 , -1.1227 , -1.0722 , -0.9754 , -0.8733 , -0.7312 , -0.5633 , -0.3809 , -0.1980 , 0.0000 };
y [36]= { 0.0000 , -0.1970 , -0.3804 , -0.5442 , -0.6761 , -0.7632 , -0.8598 , -0.9389 , -1.0126 , -1.0734 , -1.1028 , -1.1075 , -1.0583 , -0.9605 , -0.8533 , -0.7049 , -0.5508 , -0.3770 , -0.1964 , 0.0000 };
y [37]= { 0.0000 , -0.1941 , -0.3738 , -0.5314 , -0.6646 , -0.7509 , -0.8435 , -0.9209 , -0.9926 , -1.0704 , -1.0973 , -1.0762 , -1.0344 , -0.9466 , -0.8268 , -0.6783 , -0.5248 , -0.3711 , -0.1940 , 0.0000 };
y [38]= { 0.0000 , -0.1902 , -0.3696 , -0.5210 , -0.6556 , -0.7422 , -0.8279 , -0.9037 , -0.9708 , -1.0509 , -1.0702 , -1.0408 , -1.0065 , -0.9285 , -0.7996 , -0.6502 , -0.5003 , -0.3509 , -0.1900 , 0.0000 };
y [39]= { 0.0000 , -0.1820 , -0.3586 , -0.5098 , -0.6433 , -0.7359 , -0.8142 , -0.8874 , -0.9554 , -1.0186 , -1.0468 , -1.0195 , -0.9711 , -0.8971 , -0.7633 , -0.6200 , -0.4791 , -0.3380 , -0.1869 , 0.0000 };
y [40]= { 0.0000 , -0.1619 , -0.3325 , -0.4868 , -0.6272 , -0.7338 , -0.8020 , -0.8710 , -0.9375 , -0.9861 , -1.0160 , -1.0108 , -0.9578 , -0.8991 , -0.7792 , -0.6336 , -0.4899 , -0.3479 , -0.1861 , 0.0000 };
y [41]= { 0.0000 , -0.1652 , -0.3363 , -0.5218 , -0.6823 , -0.7808 , -0.8159 , -0.8481 , -0.9081 , -0.9447 , -0.9677 , -0.9947 , -0.9607 , -0.9055 , -0.8020 , -0.6620 , -0.5164 , -0.3590 , -0.1880 , 0.0000 };
y [42]= { 0.0000 , -0.1646 , -0.3531 , -0.5339 , -0.7054 , -0.7977 , -0.8162 , -0.8516 , -0.9246 , -0.9481 , -0.9468 , -0.9627 , -0.9516 , -0.8999 , -0.8099 , -0.6777 , -0.5136 , -0.3531 , -0.1878 , 0.0000 };
y [43]= { 0.0000 , -0.1217 , -0.2891 , -0.4783 , -0.6600 , -0.7805 , -0.8023 , -0.8415 , -0.9159 , -0.9632 , -0.9702 , -0.9829 , -0.9551 , -0.8822 , -0.7567 , -0.6193 , -0.4777 , -0.3367 , -0.1853 , 0.0000 };
y [44]= { 0.0000 , -0.0974 , -0.1916 , -0.3528 , -0.5398 , -0.6812 , -0.7316 , -0.7980 , -0.8768 , -0.9381 , -0.9754 , -0.9719 , -0.9228 , -0.8393 , -0.7272 , -0.5942 , -0.4601 , -0.3206 , -0.1771 , 0.0000 };
y [45]= { 0.0000 , -0.0983 , -0.1378 , -0.2498 , -0.3726 , -0.4824 , -0.5760 , -0.7026 , -0.7964 , -0.8675 , -0.8980 , -0.8805 , -0.8372 , -0.7410 , -0.6319 , -0.5250 , -0.4230 , -0.2949 , -0.1602 , 0.0000 };
y [46]= { 0.0000 , -0.0866 , -0.1141 , -0.1785 , -0.2998 , -0.4146 , -0.4691 , -0.5496 , -0.6326 , -0.6614 , -0.6651 , -0.6849 , -0.6625 , -0.5845 , -0.5005 , -0.4357 , -0.3473 , -0.2470 , -0.1417 , 0.0000 };
y [47]= { 0.0000 , -0.0817 , -0.1062 , -0.1750 , -0.2940 , -0.3927 , -0.4462 , -0.4762 , -0.5032 , -0.5320 , -0.5552 , -0.5628 , -0.5486 , -0.4951 , -0.4189 , -0.3745 , -0.3099 , -0.2212 , -0.1200 , 0.0000 };
y [48]= { 0.0000 , -0.0699 , -0.1317 , -0.2261 , -0.3299 , -0.3958 , -0.4323 , -0.4554 , -0.4635 , -0.4713 , -0.4921 , -0.4847 , -0.4619 , -0.4049 , -0.3291 , -0.3058 , -0.2672 , -0.1988 , -0.1106 , 0.0000 };
y [49]= { 0.0000 , -0.0715 , -0.1627 , -0.2520 , -0.3278 , -0.3840 , -0.4112 , -0.4191 , -0.4225 , -0.4259 , -0.4287 , -0.4368 , -0.4058 , -0.3323 , -0.2737 , -0.2685 , -0.2456 , -0.1904 , -0.1101 , 0.0000 };
y [50]= { 0.0000 , -0.0830 , -0.1666 , -0.2451 , -0.3153 , -0.3643 , -0.3745 , -0.3758 , -0.3939 , -0.4191 , -0.4265 , -0.4196 , -0.3891 , -0.3637 , -0.3576 , -0.3293 , -0.2678 , -0.1899 , -0.1038 , 0.0000 };
y [51]= { 0.0006 , -0.0701 , -0.1622 , -0.2547 , -0.3269 , -0.3677 , -0.3956 , -0.4268 , -0.4556 , -0.4768 , -0.4954 , -0.5104 , -0.5012 , -0.4672 , -0.4500 , -0.4324 , -0.3573 , -0.2327 , -0.0997 , 0.0000 };
y [52]= { 0.0000 , -0.0472 , -0.1441 , -0.2531 , -0.3368 , -0.3797 , -0.4089 , -0.4431 , -0.4779 , -0.5071 , -0.5249 , -0.5224 , -0.4877 , -0.4408 , -0.4321 , -0.4332 , -0.3648 , -0.2337 , -0.0940 , 0.0000 };
y [53]= { 0.0000 , -0.0471 , -0.1436 , -0.2477 , -0.3197 , -0.3575 , -0.3898 , -0.4258 , -0.4586 , -0.4792 , -0.4793 , -0.4674 , -0.4635 , -0.4592 , -0.4291 , -0.3718 , -0.2950 , -0.2042 , -0.1043 , 0.0000 };
y [54]= { 0.0000 , -0.2012 , -0.1787 , -0.0828 , -0.0621 , -0.1687 , -0.2951 , -0.3436 , -0.3426 , -0.3509 , -0.3665 , -0.3671 , -0.3327 , -0.2627 , -0.2533 , -0.3276 , -0.3214 , -0.2073 , -0.0708 , 0.0000 };
y [55]= { 0.0000 , -0.0581 , -0.1224 , -0.1826 , -0.2295 , -0.2621 , -0.2828 , -0.2939 , -0.2971 , -0.2936 , -0.2845 , -0.2714 , -0.2565 , -0.2425 , -0.2320 , -0.2166 , -0.1820 , -0.1282 , -0.0643 , 0.0000 };
y [56]= { 0.0000 , -0.0572 , -0.1129 , -0.1662 , -0.2166 , -0.2599 , -0.2853 , -0.2894 , -0.2869 , -0.2857 , -0.2799 , -0.2675 , -0.2531 , -0.2382 , -0.2204 , -0.1957 , -0.1594 , -0.1117 , -0.0570 , 0.0000 };
y [57]= { 0.0000 , -0.0541 , -0.0992 , -0.1407 , -0.1843 , -0.2305 , -0.2670 , -0.2885 , -0.3043 , -0.3145 , -0.3048 , -0.2770 , -0.2505 , -0.2308 , -0.2092 , -0.1803 , -0.1419 , -0.0959 , -0.0470 , 0.0000 };
y [58]= { 0.0000 , -0.0220 , -0.0433 , -0.0642 , -0.0855 , -0.1075 , -0.1299 , -0.1514 , -0.1681 , -0.1763 , -0.1729 , -0.1585 , -0.1390 , -0.1177 , -0.0959 , -0.0754 , -0.0578 , -0.0416 , -0.0234 , 0.0000 };
y [59]= { -0.0022 , -0.0043 , -0.0062 , -0.0079 , -0.0093 , -0.0106 , -0.0116 , -0.0123 , -0.0127 , -0.0129 , -0.0127 , -0.0123 , -0.0114 , -0.0103 , -0.0090 , -0.0074 , -0.0057 , -0.0038 , -0.0019 , 0.0000 };
y1=y;
z [0]= { 0.00000 , 0.00000 , 0.00000 , 0.00000 , 0.00000 , 0.00000 , 0.00000 , 0.00000 , 0.00000 , 0.00000 , 0.00000 , 0.00000 , 0.00000 , 0.00000 , 0.00000 , 0.00000 , 0.00000 , 0.00000 , 0.00000 , 0.00000 };
z [1]= { 0.16839 , 0.16615 , 0.16445 , 0.16323 , 0.16245 , 0.16217 , 0.16274 , 0.16421 , 0.16624 , 0.16855 , 0.17103 , 0.17355 , 0.17590 , 0.17796 , 0.17966 , 0.18074 , 0.18089 , 0.18017 , 0.17879 , 0.17698 };
z [2]= { 0.26975 , 0.27400 , 0.27700 , 0.27854 , 0.27837 , 0.27658 , 0.27380 , 0.27055 , 0.26711 , 0.26355 , 0.25981 , 0.25601 , 0.25251 , 0.24958 , 0.24746 , 0.24653 , 0.24716 , 0.24908 , 0.25176 , 0.25465 };
z [3]= { 0.52325 , 0.51717 , 0.51238 , 0.50931 , 0.50841 , 0.50981 , 0.51300 , 0.51757 , 0.52345 , 0.53022 , 0.53695 , 0.54320 , 0.54906 , 0.55435 , 0.55854 , 0.56070 , 0.55976 , 0.55606 , 0.55057 , 0.54430 };
z [4]= { 0.79700 , 0.78971 , 0.78554 , 0.78403 , 0.78476 , 0.78736 , 0.79161 , 0.79724 , 0.80385 , 0.81096 , 0.81801 , 0.82451 , 0.83002 , 0.83389 , 0.83548 , 0.83498 , 0.83298 , 0.82981 , 0.82562 , 0.82062 };
z [5]= { 1.08048 , 1.06731 , 1.05775 , 1.05202 , 1.05033 , 1.05289 , 1.05982 , 1.07050 , 1.08314 , 1.09656 , 1.11036 , 1.12387 , 1.13616 , 1.14655 , 1.15448 , 1.15868 , 1.15761 , 1.15143 , 1.14114 , 1.12772 };
z [6]= { 1.35756 , 1.33313 , 1.31430 , 1.30424 , 1.30613 , 1.32041 , 1.34207 , 1.36680 , 1.39237 , 1.41795 , 1.44415 , 1.46997 , 1.49289 , 1.51190 , 1.52679 , 1.53281 , 1.52363 , 1.50242 , 1.47672 , 1.45407 };
z [7]= { 1.63193 , 1.60491 , 1.58430 , 1.57370 , 1.57666 , 1.59359 , 1.61847 , 1.64642 , 1.67527 , 1.70432 , 1.73427 , 1.76378 , 1.78965 , 1.81059 , 1.82645 , 1.83363 , 1.82728 , 1.80924 , 1.78437 , 1.75759 };
z [8]= { 1.63284 , 1.64004 , 1.71474 , 1.79186 , 1.82953 , 1.81088 , 1.82170 , 1.87728 , 1.96000 , 2.04331 , 2.12745 , 2.20758 , 2.28372 , 2.30776 , 2.31127 , 2.25537 , 2.17292 , 2.10839 , 2.14752 , 2.18882 };
z [9]= { 1.63331 , 1.63293 , 1.66552 , 1.75486 , 1.83043 , 1.87703 , 1.89782 , 1.95806 , 2.04944 , 2.13911 , 2.22925 , 2.31971 , 2.40543 , 2.48251 , 2.50236 , 2.49963 , 2.44278 , 2.35230 , 2.34463 , 2.37958 };
z [10]= { 1.65354 , 1.64356 , 1.70649 , 1.78861 , 1.87731 , 1.94981 , 1.98209 , 2.05865 , 2.15777 , 2.25627 , 2.35544 , 2.45453 , 2.55320 , 2.64855 , 2.70093 , 2.71251 , 2.68541 , 2.60729 , 2.53211 , 2.54104 };
z [11]= { 1.66901 , 1.69336 , 1.75562 , 1.84311 , 1.94582 , 2.03237 , 2.07801 , 2.18368 , 2.29063 , 2.40060 , 2.51144 , 2.62347 , 2.73359 , 2.84443 , 2.92051 , 2.94158 , 2.92252 , 2.84962 , 2.75092 , 2.71334 };
z [12]= { 2.89037 , 2.98972 , 3.10234 , 3.18029 , 3.19416 , 3.17229 , 3.07314 , 2.94519 , 2.81943 , 2.69224 , 2.56541 , 2.44030 , 2.31728 , 2.19621 , 2.10079 , 2.01290 , 1.89325 , 1.78942 , 1.71093 , 1.68804 };
z [13]= { 3.35572 , 3.42447 , 3.47112 , 3.50463 , 3.45334 , 3.34231 , 3.20991 , 3.07482 , 2.93956 , 2.80341 , 2.66754 , 2.53402 , 2.40225 , 2.27639 , 2.16400 , 2.05392 , 1.93172 , 1.82095 , 1.74366 , 1.71395 };
z [14]= { 1.77891 , 1.81480 , 1.90759 , 2.03337 , 2.15808 , 2.29032 , 2.43052 , 2.57163 , 2.72196 , 2.87696 , 3.03344 , 3.18908 , 3.34377 , 3.49773 , 3.65437 , 3.79169 , 3.86338 , 3.88899 , 3.90087 , 3.94827 };
z [15]= { 1.80999 , 1.85119 , 1.94694 , 2.07660 , 2.19794 , 2.34514 , 2.49046 , 2.63720 , 2.79151 , 2.95571 , 3.11813 , 3.27914 , 3.44134 , 3.60226 , 3.76470 , 3.91362 , 4.00651 , 4.03559 , 4.06160 , 4.13492 };
z [16]= { 1.81865 , 1.86039 , 1.96762 , 2.10050 , 2.21622 , 2.37221 , 2.52424 , 2.67633 , 2.83353 , 3.00494 , 3.17208 , 3.33883 , 3.50755 , 3.67495 , 3.84114 , 4.00542 , 4.10273 , 4.14990 , 4.20153 , 4.26136 };
z [17]= { 1.76837 , 1.81378 , 1.90918 , 2.05059 , 2.19699 , 2.35059 , 2.51034 , 2.67423 , 2.84400 , 3.02074 , 3.19518 , 3.36817 , 3.54478 , 3.72007 , 3.89427 , 4.06422 , 4.18207 , 4.24254 , 4.30342 , 4.34720 };
z [18]= { 1.71634 , 1.76744 , 1.85776 , 1.99648 , 2.15280 , 2.32242 , 2.49295 , 2.66597 , 2.84162 , 3.02477 , 3.20767 , 3.38812 , 3.56995 , 3.75292 , 3.93475 , 4.10943 , 4.24052 , 4.31117 , 4.37791 , 4.44815 };
z [19]= { 1.67968 , 1.72421 , 1.80883 , 1.95177 , 2.10591 , 2.28082 , 2.46650 , 2.64408 , 2.82432 , 3.01179 , 3.19986 , 3.38745 , 3.57439 , 3.76167 , 3.94841 , 4.13281 , 4.26247 , 4.35414 , 4.41882 , 4.45211 };
z [20]= { 1.65652 , 1.69044 , 1.76883 , 1.91380 , 2.06324 , 2.24115 , 2.43032 , 2.61931 , 2.80712 , 2.99839 , 3.18987 , 3.38281 , 3.57014 , 3.75886 , 3.94917 , 4.14066 , 4.28435 , 4.37027 , 4.42122 , 4.44859 };
z [21]= { 1.63468 , 1.66814 , 1.73413 , 1.88055 , 2.02755 , 2.20267 , 2.39274 , 2.58461 , 2.77728 , 2.97179 , 3.16550 , 3.36181 , 3.54478 , 3.72956 , 3.92284 , 4.11441 , 4.28082 , 4.36325 , 4.40254 , 4.41836 };
z [22]= { 1.61639 , 1.62046 , 1.71877 , 1.85721 , 2.00280 , 2.17109 , 2.36071 , 2.55331 , 2.74748 , 2.94287 , 3.13779 , 3.33391 , 3.52277 , 3.69741 , 3.88567 , 4.07796 , 4.25128 , 4.35417 , 4.37375 , 4.38790 };
z [23]= { 1.60258 , 1.61178 , 1.69954 , 1.82881 , 1.97254 , 2.13399 , 2.31722 , 2.50785 , 2.70114 , 2.89466 , 3.08829 , 3.28200 , 3.47406 , 3.65025 , 3.82131 , 4.00993 , 4.17217 , 4.29545 , 4.31231 , 4.32164 };
z [24]= { 1.58932 , 1.60773 , 1.68126 , 1.79978 , 1.94455 , 2.09972 , 2.27781 , 2.46578 , 2.65866 , 2.85100 , 3.04386 , 3.23589 , 3.43034 , 3.60580 , 3.77458 , 3.93675 , 4.09965 , 4.22484 , 4.25522 , 4.29542 };
z [25]= { 1.57655 , 1.60093 , 1.66603 , 1.77682 , 1.92162 , 2.07576 , 2.25125 , 2.43636 , 2.63032 , 2.82263 , 3.01570 , 3.20789 , 3.40333 , 3.57908 , 3.74788 , 3.90819 , 4.03291 , 4.16065 , 4.22971 , 4.27005 };
z [26]= { 1.56422 , 1.58709 , 1.65303 , 1.76121 , 1.90053 , 2.05740 , 2.23565 , 2.41992 , 2.61467 , 2.80808 , 3.00218 , 3.19548 , 3.39210 , 3.56968 , 3.73950 , 3.89533 , 4.02012 , 4.12024 , 4.20563 , 4.24545 };
z [27]= { 1.55228 , 1.57750 , 1.64239 , 1.74674 , 1.88352 , 2.04546 , 2.22440 , 2.40827 , 2.60216 , 2.79691 , 2.99206 , 3.18675 , 3.38425 , 3.56393 , 3.73388 , 3.88602 , 3.99034 , 4.08566 , 4.18514 , 4.22217 };
z [28]= { 1.54443 , 1.57741 , 1.63810 , 1.74156 , 1.87748 , 2.04091 , 2.21879 , 2.40276 , 2.59571 , 2.79036 , 2.98603 , 3.18105 , 3.37947 , 3.55780 , 3.72988 , 3.86311 , 3.95803 , 4.05258 , 4.15026 , 4.20372 };
z [29]= { 1.54426 , 1.57696 , 1.63521 , 1.73847 , 1.87506 , 2.04186 , 2.21829 , 2.40440 , 2.59685 , 2.79071 , 2.98772 , 3.18342 , 3.38298 , 3.56069 , 3.73281 , 3.86988 , 3.95896 , 4.04317 , 4.12850 , 4.19393 };
z [30]= { 1.54408 , 1.57687 , 1.63587 , 1.73632 , 1.87445 , 2.04450 , 2.22028 , 2.40870 , 2.60176 , 2.79558 , 2.99308 , 3.19019 , 3.39039 , 3.56811 , 3.74164 , 3.87903 , 3.96842 , 4.05331 , 4.13517 , 4.19065 };
z [31]= { 1.54392 , 1.57682 , 1.63677 , 1.73464 , 1.87417 , 2.04733 , 2.22257 , 2.41311 , 2.60747 , 2.80118 , 2.99780 , 3.19693 , 3.39638 , 3.57448 , 3.74981 , 3.88752 , 3.97812 , 4.05821 , 4.13646 , 4.18742 };
z [32]= { 1.54375 , 1.57676 , 1.63768 , 1.73351 , 1.87510 , 2.05092 , 2.22682 , 2.41805 , 2.61346 , 2.80823 , 3.00416 , 3.20426 , 3.40043 , 3.57962 , 3.75766 , 3.89651 , 3.98176 , 4.05890 , 4.13793 , 4.18220 };
z [33]= { 1.54507 , 1.57666 , 1.63826 , 1.73202 , 1.87739 , 2.05360 , 2.22996 , 2.42043 , 2.61649 , 2.81202 , 3.00666 , 3.20475 , 3.40023 , 3.57946 , 3.76151 , 3.89994 , 3.98295 , 4.05994 , 4.13966 , 4.17641 };
z [34]= { 1.54886 , 1.57660 , 1.63842 , 1.72998 , 1.88054 , 2.05667 , 2.23206 , 2.41933 , 2.61540 , 2.81044 , 3.00521 , 3.20396 , 3.39831 , 3.57744 , 3.75606 , 3.90025 , 3.98521 , 4.06154 , 4.14180 , 4.17064 };
z [35]= { 1.56455 , 1.57479 , 1.64087 , 1.74212 , 1.89168 , 2.06915 , 2.24319 , 2.42560 , 2.61481 , 2.80903 , 3.00320 , 3.20217 , 3.39419 , 3.56844 , 3.74042 , 3.87806 , 3.98657 , 4.06585 , 4.14575 , 4.16181 };
z [36]= { 1.58024 , 1.57839 , 1.65054 , 1.76104 , 1.90574 , 2.08338 , 2.25504 , 2.43587 , 2.61869 , 2.80643 , 3.00086 , 3.19912 , 3.38824 , 3.55994 , 3.72652 , 3.85422 , 3.97838 , 4.06982 , 4.15026 , 4.15412 };
z [37]= { 1.59592 , 1.59626 , 1.66974 , 1.78433 , 1.92356 , 2.09870 , 2.26922 , 2.44764 , 2.62783 , 2.80747 , 2.99674 , 3.19137 , 3.38060 , 3.55381 , 3.70716 , 3.83192 , 3.95119 , 4.07017 , 4.14999 , 4.15454 };
z [38]= { 1.61161 , 1.62949 , 1.69256 , 1.81007 , 1.94326 , 2.11451 , 2.28468 , 2.45999 , 2.63803 , 2.81389 , 2.99852 , 3.18903 , 3.37596 , 3.55087 , 3.69049 , 3.80972 , 3.92787 , 4.04625 , 4.14977 , 4.15496 };
z [39]= { 1.61592 , 1.66339 , 1.72628 , 1.83893 , 1.97028 , 2.13426 , 2.30508 , 2.47793 , 2.65329 , 2.82940 , 3.01669 , 3.20066 , 3.38284 , 3.55544 , 3.68666 , 3.80851 , 3.93300 , 4.05673 , 4.16955 , 4.17432 };
z [40]= { 1.57699 , 1.67294 , 1.75257 , 1.86062 , 1.98638 , 2.14040 , 2.31653 , 2.49134 , 2.66806 , 2.84842 , 3.03569 , 3.22125 , 3.40268 , 3.58319 , 3.72471 , 3.84553 , 3.96691 , 4.09059 , 4.18689 , 4.21402 };
z [41]= { 1.57492 , 1.67289 , 1.75909 , 1.81012 , 1.91435 , 2.08188 , 2.27323 , 2.46118 , 2.64437 , 2.83227 , 3.02263 , 3.21419 , 3.40064 , 3.58609 , 3.74572 , 3.87783 , 4.00283 , 4.11265 , 4.20003 , 4.23836 };
z [42]= { 1.64919 , 1.74639 , 1.77890 , 1.84404 , 1.92402 , 2.09429 , 2.28991 , 2.47544 , 2.65465 , 2.84253 , 3.03477 , 3.22552 , 3.41637 , 3.60084 , 3.76973 , 3.90831 , 4.00685 , 4.11100 , 4.20780 , 4.24446 };
z [43]= { 1.58430 , 1.73158 , 1.82251 , 1.85410 , 1.90985 , 2.06343 , 2.25384 , 2.43945 , 2.61614 , 2.80104 , 2.99190 , 3.18282 , 3.37112 , 3.54844 , 3.69179 , 3.82470 , 3.95297 , 4.08178 , 4.19855 , 4.24416 };
z [44]= { 1.54523 , 1.70183 , 1.86057 , 1.95937 , 2.03055 , 2.13208 , 2.30388 , 2.47678 , 2.64336 , 2.81740 , 2.99801 , 3.18239 , 3.36000 , 3.52489 , 3.67068 , 3.79887 , 3.92513 , 4.04617 , 4.16136 , 4.21449 };
z [45]= { 1.58510 , 1.72441 , 1.89084 , 2.02358 , 2.14405 , 2.27502 , 2.41784 , 2.53686 , 2.67976 , 2.83811 , 3.00546 , 3.17756 , 3.34478 , 3.48618 , 3.61988 , 3.75468 , 3.89388 , 4.00813 , 4.11598 , 4.17781 };
z [46]= { 1.74276 , 1.86865 , 2.01929 , 2.15122 , 2.24959 , 2.34623 , 2.48665 , 2.61382 , 2.73945 , 2.88931 , 3.04035 , 3.19153 , 3.33834 , 3.47088 , 3.59581 , 3.73286 , 3.85424 , 3.96942 , 4.07551 , 4.13431 };
z [47]= { 1.98121 , 2.08806 , 2.22432 , 2.32829 , 2.39977 , 2.48796 , 2.60942 , 2.74049 , 2.87038 , 3.00070 , 3.13195 , 3.26466 , 3.39860 , 3.51941 , 3.62880 , 3.75457 , 3.87047 , 3.97137 , 4.05697 , 4.11626 };
z [48]= { 2.25159 , 2.34627 , 2.45273 , 2.51905 , 2.57699 , 2.67790 , 2.79122 , 2.90799 , 3.02667 , 3.14535 , 3.26265 , 3.38040 , 3.49981 , 3.60208 , 3.69276 , 3.80959 , 3.92255 , 4.02090 , 4.09993 , 4.14603 };
z [49]= { 2.46349 , 2.54818 , 2.60905 , 2.67326 , 2.75345 , 2.84803 , 2.95462 , 3.06454 , 3.17450 , 3.28428 , 3.39412 , 3.50570 , 3.60730 , 3.69501 , 3.78513 , 3.89523 , 4.00299 , 4.09989 , 4.17270 , 4.19491 };
z [50]= { 2.63736 , 2.69997 , 2.76235 , 2.83012 , 2.90813 , 2.99952 , 3.10291 , 3.20795 , 3.30978 , 3.41082 , 3.51474 , 3.61898 , 3.71858 , 3.81834 , 3.92294 , 4.02369 , 4.10655 , 4.17782 , 4.23379 , 4.25250 };
z [51]= { 2.75474 , 2.84517 , 2.92123 , 2.99646 , 3.08436 , 3.19202 , 3.30762 , 3.42036 , 3.53205 , 3.64572 , 3.76194 , 3.87933 , 3.99274 , 4.10347 , 4.22470 , 4.33937 , 4.41125 , 4.44126 , 4.44920 , 4.45503 };
z [52]= { 2.79692 , 2.91220 , 2.97689 , 3.02688 , 3.09790 , 3.20495 , 3.32241 , 3.43316 , 3.54214 , 3.65412 , 3.77046 , 3.88762 , 3.99670 , 4.10288 , 4.22480 , 4.34158 , 4.40757 , 4.42535 , 4.42369 , 4.43161 };
z [53]= { 2.83902 , 2.94488 , 2.97697 , 2.99371 , 3.05045 , 3.15010 , 3.25328 , 3.34752 , 3.44354 , 3.54438 , 3.64620 , 3.74790 , 3.85056 , 3.95253 , 4.04976 , 4.13657 , 4.20664 , 4.25379 , 4.27190 , 4.25485 };
z [54]= { 2.84874 , 2.85289 , 2.92208 , 3.00629 , 3.05606 , 3.06235 , 3.08263 , 3.16588 , 3.28482 , 3.39531 , 3.49696 , 3.60159 , 3.70520 , 3.80048 , 3.89099 , 3.97881 , 4.05662 , 4.11712 , 4.15387 , 4.16040 };
z [55]= { 2.85853 , 2.88564 , 2.90239 , 2.92491 , 2.96705 , 3.02494 , 3.08737 , 3.15070 , 3.21500 , 3.27964 , 3.34372 , 3.40693 , 3.46946 , 3.53248 , 3.59733 , 3.66009 , 3.71361 , 3.75205 , 3.77047 , 3.76396 };
z [56]= { 2.84240 , 2.83540 , 2.84084 , 2.85812 , 2.88660 , 2.92562 , 2.97440 , 3.03056 , 3.08857 , 3.14509 , 3.20069 , 3.25589 , 3.31072 , 3.36514 , 3.41897 , 3.47000 , 3.51384 , 3.54546 , 3.55931 , 3.54984 };
z [57]= { 2.80528 , 2.79641 , 2.81070 , 2.83672 , 2.86305 , 2.88507 , 2.91516 , 2.95966 , 3.01036 , 3.06017 , 3.10582 , 3.14811 , 3.19159 , 3.23712 , 3.28192 , 3.32274 , 3.35589 , 3.37632 , 3.37806 , 3.35512 };
z [58]= { 3.19340 , 3.19611 , 3.20313 , 3.21101 , 3.21634 , 3.21675 , 3.21320 , 3.20585 , 3.19149 , 3.16993 , 3.14777 , 3.13038 , 3.11954 , 3.11331 , 3.10763 , 3.09926 , 3.08603 , 3.07078 , 3.05888 , 3.05574 };
z [59]= { 3.14367 , 3.14322 , 3.14243 , 3.14133 , 3.13998 , 3.13841 , 3.13667 , 3.13481 , 3.13286 , 3.13088 , 3.12890 , 3.12698 , 3.12515 , 3.12345 , 3.12192 , 3.12059 , 3.11951 , 3.11870 , 3.11821 , 3.11807 };
z1=z;
pointtorso=Point.ByCoordinates(x1,y1,z1);
//CURVES AND SURFACE TORSO
curvestorso=NurbsCurve.ByPoints(pointtorso);
surfacetorso=Surface.ByLoft(curvestorso);

//LIST OF GEOMETRY FOR HALF OF COW
halfcow={eyeball,horn,surfacefrontleg,surfacetorso};

//MIRROR HALF COW;
point_origin=Point.ByCoordinates(0,0,0);
vector_y_axis=Vector.ByCoordinates(0,1,0);
plane_origin_by_normal=Plane.ByOriginNormal(point_origin,vector_y_axis);
mirrorhalfcow=halfcow.Mirror(plane_origin_by_normal);

//ALLNURBS_CURVES
curvestorso2=curvestorso;
curvesfrontleg2=curvesfrontleg;
mirrorcurvestorso=curvestorso.Mirror(plane_origin_by_normal);
mirrorcurvesfrontleg=curvesfrontleg.Mirror(plane_origin_by_normal);
# ----------------------------------------
code_block_2 = CodeBlock { 5; }
code_block_3 = CodeBlock(scale=code_block_2) { scale; }
scale = Geometry.Scale(code_block.curvesfrontleg2, code_block_3)
referenceCurveByCurve = ModelCurve.ReferenceCurveByCurve(scale)
boolean = BoolSelector(true)
byLoftCrossSections = Form.ByLoftCrossSections(referenceCurveByCurve, boolean)
scale_2 = Geometry.Scale(code_block.curvestorso2, code_block_3)
referenceCurveByCurve_2 = ModelCurve.ReferenceCurveByCurve(scale_2)
boolean_2 = BoolSelector(true)
byLoftCrossSections_2 = Form.ByLoftCrossSections(referenceCurveByCurve_2, boolean_2)
scale_3 = Geometry.Scale(code_block.mirrorcurvestorso, code_block_3)
referenceCurveByCurve_3 = ModelCurve.ReferenceCurveByCurve(scale_3)
boolean_3 = BoolSelector(true)
byLoftCrossSections_3 = Form.ByLoftCrossSections(referenceCurveByCurve_3, boolean_3)
scale_4 = Geometry.Scale(code_block.mirrorcurvesfrontleg, code_block_3)
referenceCurveByCurve_4 = ModelCurve.ReferenceCurveByCurve(scale_4)
boolean_4 = BoolSelector(true)
byLoftCrossSections_4 = Form.ByLoftCrossSections(referenceCurveByCurve_4, boolean_4)
