# Dynamo graph CRICKET_FINAL.dyn (Dynamo 0.7.5.3272)

file_path = Filename("E:\BACKUP\Personal\Presentation\Presentation_14_12_03_AUTODESK_UNIVERSITY_2014\01_DYNAMO LECTURE\EXERSIZES\EX_04_EXTRACT_AC_COMPONENTS_CRICKETS\CRICKET_START.xlsx")
string = StringInput("Sheet1")
number = DoubleInput(0)
number_2 = DoubleInput(0)
family_types = FamilyTypes("ROOF_CRICKET:ROOF_CRICKET")
all_elements_of_family_type = ElementsOfFamilyType(family_types)
placementPointLocations = AdaptiveComponent.Locations(all_elements_of_family_type)  # "AdaptiveComponent.PlacementPointLocations"
writeToFile = Excel.WriteToFile(file_path, string, number, number_2, placementPointLocations)
watch = Watch(all_elements_of_family_type)
