# Dynamo graph CURVED_BEAM_MULTIPLE_FINAL.dyn (Dynamo 0.7.5.3272)

element_types = ElementTypes("CurveElement")
all_elements_of_type = ElementsOfType(element_types)
geometry = Element.Geometry(all_elements_of_type)
ZAxis = Vector.ZAxis()
code_block = CodeBlock { 8; }
extrude = Curve.Extrude(geometry, ZAxis, code_block)
select_face = DSFaceSelection()  # 1 picked in the model
intersectAll = Geometry.IntersectAll(extrude, select_face)
code_block_2 = CodeBlock { 2; }
flatten = List.Flatten(intersectAll, code_block_2)
levels = Levels("Level 5")
structural_framing_types = StructuralFramingTypes("W30X90")
beamByCurve = StructuralFraming.BeamByCurve(flatten, levels, structural_framing_types)
curve = Grid.Curve()
