# Dynamo graph DESIGN_SCRIPT_MASS_FINAL.dyn (Dynamo 0.7.4.3245)

code_block = CodeBlock()
# ---------- code_block.designscript (5 lines) ----------
pt1=Autodesk.DesignScript.Geometry.Point.ByCoordinates(0,0,0);
pt2=Autodesk.DesignScript.Geometry.Point.ByCoordinates(0,25,0);
pt3=Autodesk.DesignScript.Geometry.Point.ByCoordinates(25,0,0);
pt4=Autodesk.DesignScript.Geometry.Point.ByCoordinates(25,25,0);
list={pt1,pt2,pt3,pt4};
# ----------------------------------------
number = DoubleInput(2)
scale = Geometry.Scale(code_block.list, number)
byPoint = ReferencePoint.ByPoint(scale)
number_2 = DoubleInput(0)
byCoordinates = Point.ByCoordinates(number_2, number_2, number_2)
number_3 = DoubleInput(25)
byCoordinates_2 = Point.ByCoordinates(number_3, number_2, number_2)
byCoordinates_3 = Point.ByCoordinates(number_2, number_3, number_2)
byCoordinates_4 = Point.ByCoordinates(number_3, number_3, number_2)
create = List.Create()
