# Dynamo graph DESIGN_SCRIPT_MASS_MID.dyn (Dynamo 0.7.4.3245)

number = DoubleInput(0)
byCoordinates = Point.ByCoordinates(number, number, number)
number_2 = DoubleInput(25)
byCoordinates_2 = Point.ByCoordinates(number_2, number, number)
byCoordinates_3 = Point.ByCoordinates(number, number_2, number)
byCoordinates_4 = Point.ByCoordinates(number_2, number_2, number)
create = List.Create(byCoordinates, byCoordinates_2, byCoordinates_3, byCoordinates_4)
number_3 = DoubleInput(2)
scale = Geometry.Scale(create, number_3)
byPoint = ReferencePoint.ByPoint(scale)
