# Dynamo graph Diabolo Column Rebar Base Part_demo.dyn (Dynamo 0.9.0.3067)

select_model_element = DSModelElementSelection()  # 1 picked in the model

# group: Translation of selected geometry to the Dynamo WCS for optimal graphical performance
faces = Element.Faces(select_model_element)
geometry = Element.Geometry(select_model_element)
code_block = CodeBlock(lst=geometry) { lst[0]; }
byGeometry = BoundingBox.ByGeometry(code_block)
minPoint = BoundingBox.MinPoint(byGeometry)
asVector = Point.AsVector(minPoint)
reverse = Vector.Reverse(asVector)
translate = Geometry.Translate(geometry=faces, direction=reverse, lacing=Longest)

# group: Visualization of translated surfaces
code_block_2 = CodeBlock { 100; 128; 0; 255; }
byARGB = Color.ByARGB(a=code_block_2.out0, r=code_block_2.out2, g=code_block_2.out2, b=code_block_2.out1)
byGeometryColor = Display.Display.ByGeometryColor(translate, byARGB)

code_block_3 = CodeBlock(lst=translate)
# ---------- code_block_3.designscript (18 lines) ----------
//Discretization of element faces
//Bottom surface
lst[0];
//Top surface
lst[1];
//Other faces
lst[2];
lst[3];
lst[4];
lst[5];
lst[6];
lst[7];
lst[8];
lst[9];
lst[10];
lst[11];
lst[12];
lst[13];
# ----------------------------------------

# group: Detection of local axes and planes of the element
vertices = Face.Vertices(code_block_3.out0)
pointGeometry = Vertex.PointGeometry(vertices)
# note: Detection of X-axis line
byBestFitThroughPoints = Line.ByBestFitThroughPoints(pointGeometry)
code_block_4 = CodeBlock { 255; 0; }
# note: Visualization of local axis lines as a gizmo
byARGB_2 = Color.ByARGB(a=code_block_4.out1, r=code_block_4.out0, g=code_block_4.out1, b=code_block_4.out1)
# note: Red X-axis line
byGeometryColor_2 = Display.Display.ByGeometryColor(byBestFitThroughPoints, byARGB_2)
code_block_5 = CodeBlock { 0.5; }
# note: Center Point
pointAtParameter = Surface.PointAtParameter(surface=code_block_3.out0, u=code_block_5, v=code_block_5)
# note: Z-axis at center of bottom surface
normalAtParameter = Surface.NormalAtParameter(surface=code_block_3.out0, u=code_block_5, v=code_block_5)
# note: Z-axis vector
# Normal vector is always pointing outside of surface, so we need to reverse it
reverse_2 = Vector.Reverse(normalAtParameter)
code_block_6 = CodeBlock { 90; }
# note: Y-axis by rotating X-axis line by 90° around Z-axis vector
rotate = Geometry.Rotate(geometry=byBestFitThroughPoints, origin=pointAtParameter, axis=reverse_2, degrees=code_block_6)
byARGB_3 = Color.ByARGB(a=code_block_4.out1, r=code_block_4.out1, g=code_block_4.out0, b=code_block_4.out1)
# note: Green Y-axis line
byGeometryColor_3 = Display.Display.ByGeometryColor(rotate, byARGB_3)
code_block_7 = CodeBlock { 1000; }
# note: Visualisation of Z-axis line
byStartPointDirectionLength = Line.ByStartPointDirectionLength(startPoint=pointAtParameter, direction=reverse_2, length=code_block_7)
byARGB_4 = Color.ByARGB(a=code_block_4.out1, r=code_block_4.out1, g=code_block_4.out1, b=code_block_4.out0)
# note: Blue Z-axis line
byGeometryColor_4 = Display.Display.ByGeometryColor(byStartPointDirectionLength, byARGB_4)
# note: X-axis vector
direction = Line.Direction(byBestFitThroughPoints)
# note: Y-axis vector
direction_2 = Line.Direction(rotate)
# note: Local XZ plane
byOriginXAxisYAxis = Plane.ByOriginXAxisYAxis(pointAtParameter, direction, reverse_2)
# note: Local YZ plane
byOriginXAxisYAxis_2 = Plane.ByOriginXAxisYAxis(pointAtParameter, direction_2, reverse_2)
# note: Local XY plane
byOriginXAxisYAxis_3 = Plane.ByOriginXAxisYAxis(pointAtParameter, direction, direction_2)

# group: Read rebar configuration from Excel
# note: Make sure you browse to the right location of your Excel file on your disk
file_path = Filename("D:\Box Sync\04 - Datasets\Dynamo\Rebar modelling\Diabolo Column Pier\Diabolo Column Rebar Configuration.xlsx")
fromPath = FileObject(file_path)  # "File.FromPath"
code_block_8 = CodeBlock { "Base Part"; }
readFromFile = Excel.ReadFromFile(file=fromPath, sheetName=code_block_8)
transpose = List.Transpose(readFromFile)
code_block_9 = CodeBlock(lst=transpose) { lst[0]; lst[1]; }
restOfItems = List.RestOfItems(code_block_9.out0)
watch = Watch(restOfItems)
restOfItems_2 = List.RestOfItems(code_block_9.out1)
code_block_10 = CodeBlock(lst=restOfItems_2)
# ---------- code_block_10.designscript (44 lines) ----------
//Material indication string
lst[0];
//Diameter of longitudinal reinforcement at the core front face
lst[1];
//Number of rebars at core front face
lst[2];
//Number of rebars at core side face
lst[3];
//Number of layers for longitudinal reinforcement at the core front face
lst[4];
//Number of layers for longitudinal reinforcement at the core slanted side face
lst[5];
//Distance from face to center of longitudinal reinforcement of core
lst[6];
//Diameter of longitudinal reinforcement at the buttress front face
lst[7];
//Number of rebars at buttress front face
lst[8];
//Number of rebars at buttress side face
lst[9];
//Number of layers for longitudinal reinforcement at the buttress front face
lst[10];
//Number of layers for longitudinal reinforcement at the buttress side face
lst[11];
//Distance from face to center of longitudinal reinforcement of buttress
lst[12];
//Diameter of the hairpins
lst[13];
//Distance between hairpins
lst[14];
//Distance from face to center of hairpins
lst[15];
//Diameter of the transversal rebars
lst[16];
//Distance between transversal rebars
lst[17];
//Distance from face to center of transversal rebars
lst[18];
//Shift distance for transversal rebars (= diameter hairpin core)
lst[19];
//Distance between bottom face and the first hairpin face
lst[20];
//Cover to bar face
lst[21];
# ----------------------------------------

# group: Longitudinal rebar lines front face column (faces 7 & 13)
join = List.Join(code_block_3.out7, code_block_3.out13)
code_block_11 = CodeBlock(num_rebars=code_block_10.out2, center_distance=code_block_10.out6, num_layers=code_block_10.out4, diameter=code_block_10.out1, cover=code_block_10.out21) { num_rebars; -center_distance..#num_layers..-(diameter+cover); }
boolean = BoolSelector(false)
boolean_2 = BoolSelector(false)
followingSurface = DynamoRebar.Rebar.FollowingSurface(arg1=code_block_11.num_rebars, arg3=boolean, arg4=code_block_11.out1, arg5=boolean_2, lacing=Longest)
map = List.Map(list=join, f_x=followingSurface)
code_block_12 = CodeBlock { 1; }
flatten = List.Flatten(list=map, amt=code_block_12)

# group: Longitudinal rebar lines slanted face column (faces 2, 6, 8 & 12)
create = List.Create(code_block_3.out2, code_block_3.out6, code_block_3.out8, code_block_3.out12)
code_block_13 = CodeBlock(num_rebars=code_block_10.out3, center_distance=code_block_10.out6, num_layers=code_block_10.out5, diameter=code_block_10.out1, cover=code_block_10.out21) { num_rebars; -center_distance..#num_layers..-(diameter+cover); }
boolean_3 = BoolSelector(false)
boolean_4 = BoolSelector(false)
followingSurface_2 = DynamoRebar.Rebar.FollowingSurface(arg1=code_block_13.num_rebars, arg3=boolean_3, arg4=code_block_13.out1, arg5=boolean_4, lacing=Longest)
map_2 = List.Map(list=create, f_x=followingSurface_2)
code_block_14 = CodeBlock { 1; }
flatten_2 = List.Flatten(list=map_2, amt=code_block_14)

# group: Creation of longitudinal rebars @ core bearing part
join_2 = List.Join(flatten, flatten_2)
id = Element.Id(select_model_element)
rebar_style = RebarStyle("Standard")
code_block_15 = CodeBlock(diameter=code_block_10.out1, material=code_block_10.out0) { String.FromObject(diameter)+ " " + material; }
byName = RebarBarType.ByName(code_block_15)
rebar_hook_orientation = RebarHookOrientation("Left")
rebar_hook_orientation_2 = RebarHookOrientation("Left")
rebar_hook_type = RevitRebarHookType("None")
rebar_hook_type_2 = RevitRebarHookType("None")
# note: Translate the generated reinforcement from the Dynamo orientated WCS to the Revit orientated WCS
translate_2 = Geometry.Translate(direction=asVector)
normal = Curve.Normal(translate_2)
byCurve = RebarContainer.ByCurve(arg1=id, arg2=rebar_style, arg3=byName, arg4=rebar_hook_orientation, arg5=rebar_hook_orientation_2, arg6=rebar_hook_type, arg7=rebar_hook_type_2, arg8=normal, lacing=Longest)

# group: Longitudinal rebar lines front face buttress (faces 4 & 10)
join_3 = List.Join(code_block_3.out4, code_block_3.out10)
code_block_16 = CodeBlock(num_rebars=code_block_10.out8, center_distance=code_block_10.out12, num_layers=code_block_10.out10, diameter=code_block_10.out7, cover=code_block_10.out21) { num_rebars; -center_distance..#num_layers..-(diameter+cover); }
boolean_5 = BoolSelector(false)
boolean_6 = BoolSelector(false)
followingSurface_3 = DynamoRebar.Rebar.FollowingSurface(arg1=code_block_16.num_rebars, arg3=boolean_5, arg4=code_block_16.out1, arg5=boolean_6, lacing=Longest)
map_3 = List.Map(list=join_3, f_x=followingSurface_3)
code_block_17 = CodeBlock { 1; }
flatten_3 = List.Flatten(list=map_3, amt=code_block_17)

# group: Longitudinal rebar lines along side face buttress (faces 3, 5, 9 & 11)
# note: Get edge of triangular stud by intersecting
# face 3 & 4.
intersect = Geometry.Intersect(geometry=code_block_3.out3, other=code_block_3.out4)
code_block_18 = CodeBlock(lst=intersect) { lst[0]; }
code_block_19 = CodeBlock(num_rebars=code_block_10.out9, center_distance=code_block_10.out12) { num_rebars; center_distance*2..#num_rebars..220; center_distance; }
translate_3 = Geometry.Translate(geometry=code_block_18, direction=direction, distance=code_block_19.out1, lacing=Longest)
translate_4 = Geometry.Translate(geometry=translate_3, direction=direction_2, distance=code_block_19.center_distance, lacing=Longest)
mirror = Geometry.Mirror(geometry=translate_4, mirrorPlane=byOriginXAxisYAxis, lacing=Longest)
mirror_2 = Geometry.Mirror(geometry=translate_4, mirrorPlane=byOriginXAxisYAxis_2, lacing=Longest)
mirror_3 = Geometry.Mirror(geometry=mirror, mirrorPlane=byOriginXAxisYAxis_2, lacing=Longest)
create_2 = List.Create(translate_4, mirror, mirror_2, mirror_3)

# group: Creation of longitudinal rebars @ buttress part
join_4 = List.Join(flatten_3, create_2)
id_2 = Element.Id(select_model_element)
rebar_style_2 = RebarStyle("Standard")
code_block_20 = CodeBlock(diameter=code_block_10.out7, material=code_block_10.out0) { String.FromObject(diameter)+ " " + material; }
byName_2 = RebarBarType.ByName(code_block_20)
rebar_hook_orientation_3 = RebarHookOrientation("Left")
rebar_hook_orientation_4 = RebarHookOrientation("Left")
rebar_hook_type_3 = RevitRebarHookType("None")
rebar_hook_type_4 = RevitRebarHookType("None")
# note: Translate the generated reinforcement from the Dynamo orientated WCS to the Revit orientated WCS
translate_5 = Geometry.Translate(direction=asVector)
normal_2 = Curve.Normal(translate_5)
byCurve_2 = RebarContainer.ByCurve(arg1=id_2, arg2=rebar_style_2, arg3=byName_2, arg4=rebar_hook_orientation_3, arg5=rebar_hook_orientation_4, arg6=rebar_hook_type_3, arg7=rebar_hook_type_4, arg8=normal_2, lacing=Longest)

# group: Hairpin & Transversal rebar placement calculation
code_block_21 = CodeBlock { "Base Level"; "Base Offset"; "Top Level"; "Top Offset"; }
create_3 = List.Create(code_block_21.out0, code_block_21.out1, code_block_21.out2, code_block_21.out3)
getParameterValueByName = Element.GetParameterValueByName(element=select_model_element, parameterName=create_3)
code_block_22 = CodeBlock(lst=getParameterValueByName) { z_top=Math.Round(lst[2].Elevation,2)+lst[3]; z_bottom=Math.Round(lst[0].Elevation,2)+lst[1]; height=z_top-z_bottom; }
code_block_23 = CodeBlock(h=code_block_22.height, min_bottom_cover=code_block_10.out20, diameter=code_block_10.out16, pitch=code_block_10.out17, shift=code_block_10.out19)
# ---------- code_block_23.designscript (5 lines) ----------
//Code to calculate the distance ranges for the transversal bar centers
nr=Math.Floor((h-2*min_bottom_cover-diameter)/pitch);
start=(h-nr*pitch)/2;
start+shift..h..pitch;
start-shift..h..pitch;
# ----------------------------------------
code_block_24 = CodeBlock(h=code_block_22.height, min_bottom_cover=code_block_10.out20, diameter=code_block_10.out13, pitch=code_block_10.out14)
# ---------- code_block_24.designscript (4 lines) ----------
//Code to calculate the distance ranges for the hairpin centers
nr=Math.Floor((h-2*min_bottom_cover-diameter)/pitch);
start=(h-nr*pitch)/2;
start..h..pitch;
# ----------------------------------------

# group: Transversal lines at core bearing part
# note: Offset the faces to get their vertical intersections. Offset from the side equals the excel setting. Offset from the front is added with 100 mm extra.
code_block_25 = CodeBlock(c=code_block_10.out18)
# ---------- code_block_25.designscript (3 lines) ----------
//c=cover to center;
-c;
-c-100;
# ----------------------------------------
# note: Side slanted face 12
offset = Surface.Offset(code_block_3.out12, code_block_25.out0)
# note: Front face 13
offset_2 = Surface.Offset(code_block_3.out13, code_block_25.out1)
intersect_2 = Geometry.Intersect(geometry=offset, other=offset_2)
offset_3 = Plane.Offset(byOriginXAxisYAxis_3, code_block_23.out2)
intersect_3 = Geometry.Intersect(geometry=intersect_2, other=offset_3, lacing=Longest)
# note: Side slanted face 8
offset_4 = Surface.Offset(code_block_3.out8, code_block_25.out0)
# note: Back face 7
offset_5 = Surface.Offset(code_block_3.out7, code_block_25.out1)
# note: Intersect the edges with the center planes of the bars to get the connecting points
intersect_4 = Geometry.Intersect(geometry=offset_4, other=offset_5)
intersect_5 = Geometry.Intersect(geometry=intersect_4, other=offset_3, lacing=Longest)
byStartPointEndPoint = Line.ByStartPointEndPoint(startPoint=intersect_3, endPoint=intersect_5)
flatten_4 = Flatten(byStartPointEndPoint)
# note: Mirrorplane = local YZ
mirror_4 = Geometry.Mirror(geometry=flatten_4, mirrorPlane=byOriginXAxisYAxis_2)
create_4 = List.Create(flatten_4, mirror_4)

# group: Transversal lines at buttress part
# note: Offset the faces to get their vertical intersections. Offset from the side equals the excel setting. Offset from the front is added with 100 mm extra.
code_block_26 = CodeBlock(c=code_block_10.out18)  # same code as code_block_25
# note: Side slanted face 11
offset_6 = Surface.Offset(code_block_3.out11, code_block_26.out0)
# note: Front face 10
offset_7 = Surface.Offset(code_block_3.out10, code_block_26.out1)
intersect_6 = Geometry.Intersect(geometry=offset_6, other=offset_7)
offset_8 = Plane.Offset(byOriginXAxisYAxis_3, code_block_23.out3)
intersect_7 = Geometry.Intersect(geometry=intersect_6, other=offset_8, lacing=Longest)
# note: Side slanted face 3
offset_9 = Surface.Offset(code_block_3.out3, code_block_26.out0)
# note: Back face 4
offset_10 = Surface.Offset(code_block_3.out4, code_block_26.out1)
# note: Intersect the edges with the center planes of the bars to get the connecting points
intersect_8 = Geometry.Intersect(geometry=offset_9, other=offset_10)
intersect_9 = Geometry.Intersect(geometry=intersect_8, other=offset_8, lacing=Longest)
byStartPointEndPoint_2 = Line.ByStartPointEndPoint(startPoint=intersect_7, endPoint=intersect_9)
flatten_5 = Flatten(byStartPointEndPoint_2)
# note: Mirrorplane = local XZ
mirror_5 = Geometry.Mirror(geometry=flatten_5, mirrorPlane=byOriginXAxisYAxis)
create_5 = List.Create(flatten_5, mirror_5)

# group: Creation of transversal rebars @ core & buttress part
join_5 = List.Join(create_4, create_5)
id_3 = Element.Id(select_model_element)
rebar_style_3 = RebarStyle("Standard")
code_block_27 = CodeBlock(diameter=code_block_10.out16, material=code_block_10.out0) { String.FromObject(diameter)+ " " + material; }
byName_3 = RebarBarType.ByName(code_block_27)
rebar_hook_orientation_5 = RebarHookOrientation("Left")
rebar_hook_orientation_6 = RebarHookOrientation("Left")
rebar_hook_type_5 = RevitRebarHookType("None")
rebar_hook_type_6 = RevitRebarHookType("None")
# note: Translate the generated reinforcement from the Dynamo orientated WCS to the Revit orientated WCS
translate_6 = Geometry.Translate(direction=asVector)
normal_3 = Curve.Normal(translate_6)
byCurve_3 = RebarContainer.ByCurve(arg1=id_3, arg2=rebar_style_3, arg3=byName_3, arg4=rebar_hook_orientation_5, arg5=rebar_hook_orientation_6, arg6=rebar_hook_type_5, arg7=rebar_hook_type_6, arg8=normal_3, lacing=Longest)

# group: Variable width hairpin lines at core bearing part
# note: Create a polysurface from the front and slanted side faces (2, 13 & 12)
create_6 = List.Create(code_block_3.out2, code_block_3.out13, code_block_3.out12)
byJoinedSurfaces = PolySurface.ByJoinedSurfaces(create_6)
# note: Copy the local XY plane as stirrup centerplanes
offset_11 = Plane.Offset(byOriginXAxisYAxis_3, code_block_24.out2)
intersect_10 = Geometry.Intersect(geometry=byJoinedSurfaces, other=offset_11, lacing=Longest)
byJoinedCurves = PolyCurve.ByJoinedCurves(intersect_10)
code_block_28 = CodeBlock(c=code_block_10.out15)
# ---------- code_block_28.designscript (2 lines) ----------
//c = cover to center;
{-c,c};
# ----------------------------------------
boolean_7 = BoolSelector(false)
offset_12 = PolyCurve.Offset(arg1=code_block_28, arg2=boolean_7, lacing=Longest)
# note: Offset the resulting curves with the cover setting. As the offset might result in new curves outside the geometry, + and - values are considered and the shortest polycurve is filtered (this is the internal offsetted curve).
map_4 = List.Map(list=byJoinedCurves, f_x=offset_12)
length = Curve.Length()
minimumItemByKey = MinimumItemByKey(arg1=length, lacing=Longest)
map_5 = List.Map(list=map_4, f_x=minimumItemByKey)
explode = Geometry.Explode(map_5)
byJoinedCurves_2 = PolyCurve.ByJoinedCurves(explode)
# note: Mirrorplane = local XZ
mirror_6 = Geometry.Mirror(geometry=byJoinedCurves_2, mirrorPlane=byOriginXAxisYAxis, lacing=Longest)
create_7 = List.Create(byJoinedCurves_2, mirror_6)

# group: Hairpin lines at triangular buttress
# note: Create a polysurface from triangular stud faces (9, 10 & 11)
create_8 = List.Create(code_block_3.out9, code_block_3.out10, code_block_3.out11)
byJoinedSurfaces_2 = PolySurface.ByJoinedSurfaces(create_8)
# note: Intersect with the local XY plane to get the polycurve formed by the three planes
intersect_11 = Geometry.Intersect(geometry=byJoinedSurfaces_2, other=byOriginXAxisYAxis_3, lacing=Longest)
byJoinedCurves_3 = PolyCurve.ByJoinedCurves(intersect_11)
code_block_29 = CodeBlock(c=code_block_10.out15)
# ---------- code_block_29.designscript (2 lines) ----------
//c=cover to center;
{-c,c};
# ----------------------------------------
boolean_8 = BoolSelector(false)
offset_13 = PolyCurve.Offset(arg1=code_block_29, arg2=boolean_8, lacing=Longest)
# note: Offset the resulting curves with the cover setting. As the offset might result in new curves outside the geometry, + and - values are considered and the shortest polycurve is filtered (this is the internal offsetted curve).
map_6 = List.Map(list=byJoinedCurves_3, f_x=offset_13)
length_2 = Curve.Length()
minimumItemByKey_2 = MinimumItemByKey(arg1=length_2, lacing=Longest)
map_7 = List.Map(list=map_6, f_x=minimumItemByKey_2)
explode_2 = Geometry.Explode(map_7)
byJoinedCurves_4 = PolyCurve.ByJoinedCurves(explode_2)
# note: Intersection of face 9 and 10 results in de edge which defines the vertical array direction of the stirrups.
intersect_12 = Geometry.Intersect(geometry=code_block_3.out9, other=code_block_3.out10, lacing=Longest)
direction_3 = Line.Direction(intersect_12)
translate_7 = Geometry.Translate(geometry=byJoinedCurves_4, direction=direction_3, distance=code_block_24.out2, lacing=Longest)
# note: Mirrorplane = local YZ
mirror_7 = Geometry.Mirror(geometry=translate_7, mirrorPlane=byOriginXAxisYAxis_2, lacing=Longest)
create_9 = List.Create(translate_7, mirror_7)

# group: Creation of hairpins @ core & buttress part (variable width)
translate_8 = Geometry.Translate(direction=asVector)
join_6 = List.Join(create_7, create_9)
# note: Translate the generated reinforcement from the Dynamo orientated WCS to the Revit orientated WCS
flatten_6 = Flatten(join_6)
id_4 = Element.Id(select_model_element)
rebar_style_4 = RebarStyle("StirrupTie")
code_block_30 = CodeBlock(diameter=code_block_10.out13, material=code_block_10.out0) { String.FromObject(diameter)+ " " + material; }
byName_4 = RebarBarType.ByName(code_block_30)
rebar_hook_orientation_7 = RebarHookOrientation("Left")
rebar_hook_orientation_8 = RebarHookOrientation("Left")
rebar_hook_type_7 = RevitRebarHookType("None")
rebar_hook_type_8 = RevitRebarHookType("None")
ZAxis = Vector.ZAxis()
byCurve_4 = Rebar.ByCurve(arg1=id_4, arg2=rebar_style_4, arg3=byName_4, arg4=rebar_hook_orientation_7, arg5=rebar_hook_orientation_8, arg6=rebar_hook_type_7, arg7=rebar_hook_type_8, arg8=ZAxis)

# group: View representation of Rebars
views = Views("Column - Formwork &amp; Rebar")
views_2 = Views("Column - Bottom Part")
views_3 = Views("Column - Top Part")
views_4 = Views("Column - Rebar")
views_5 = Views("Column - Half Section 1")
views_6 = Views("Column - Half Section 2")
create_10 = List.Create(views, views_2, views_3, views_4, views_5, views_6)
boolean_9 = BoolSelector(true)
setSolidInView = RebarContainer.SetSolidInView(byCurve, arg2=boolean_9, lacing=Longest)
map_8 = List.Map(list=create_10, f_x=setSolidInView)
setSolidInView_2 = RebarContainer.SetSolidInView(byCurve_2, arg2=boolean_9, lacing=Longest)
map_9 = List.Map(list=create_10, f_x=setSolidInView_2)
setSolidInView_3 = Rebar.SetSolidInView(byCurve_4, arg2=boolean_9, lacing=Longest)
map_10 = List.Map(list=create_10, f_x=setSolidInView_3)
setSolidInView_4 = RebarContainer.SetSolidInView(byCurve_3, arg2=boolean_9, lacing=Longest)
map_11 = List.Map(list=create_10, f_x=setSolidInView_4)
