# Dynamo graph Diabolo Column Rebar Top Part_demo.dyn (Dynamo 0.9.0.3067)

select_model_element = DSModelElementSelection()  # 1 picked in the model

# group: Translation of selected geometry to the Dynamo WCS for optimal graphical performance
faces = Element.Faces(select_model_element)
geometry = Element.Geometry(select_model_element)
code_block = CodeBlock(lst=geometry) { lst[0]; }
byGeometry = BoundingBox.ByGeometry(code_block)
minPoint = BoundingBox.MinPoint(byGeometry)
asVector = Point.AsVector(minPoint)
reverse = Vector.Reverse(asVector)
translate = Geometry.Translate(geometry=faces, direction=reverse, lacing=Longest)

# group: Visualization of translated surfaces
code_block_2 = CodeBlock { 100; 128; 0; 255; }
byARGB = Color.ByARGB(a=code_block_2.out0, r=code_block_2.out2, g=code_block_2.out2, b=code_block_2.out1)
byGeometryColor = Display.Display.ByGeometryColor(translate, byARGB)

code_block_3 = CodeBlock(lst=translate)
# ---------- code_block_3.designscript (14 lines) ----------
//Discretization of element faces
//Top surfaces
lst[0];
lst[1];
//Bottom Surface
lst[2];
//Other faces
lst[3];
lst[4];
lst[5];
lst[6];
lst[7];
lst[8];
lst[9];
# ----------------------------------------

# group: Detection of local axes and planes of the element
vertices = Face.Vertices(code_block_3.out2)
pointGeometry = Vertex.PointGeometry(vertices)
# note: Detection of X-axis line
byBestFitThroughPoints = Line.ByBestFitThroughPoints(pointGeometry)
code_block_4 = CodeBlock { 255; 0; }
# note: Visualization of local axis lines as a gizmo
byARGB_2 = Color.ByARGB(a=code_block_4.out1, r=code_block_4.out0, g=code_block_4.out1, b=code_block_4.out1)
# note: Red X-axis line
byGeometryColor_2 = Display.Display.ByGeometryColor(byBestFitThroughPoints, byARGB_2)
code_block_5 = CodeBlock { 0.5; }
# note: Center Point
pointAtParameter = Surface.PointAtParameter(surface=code_block_3.out2, u=code_block_5, v=code_block_5)
# note: Z-axis at center of bottom surface
normalAtParameter = Surface.NormalAtParameter(surface=code_block_3.out2, u=code_block_5, v=code_block_5)
# note: Z-axis vector
# Normal vector is always pointing outside of surface, so we need to reverse it
reverse_2 = Vector.Reverse(normalAtParameter)
code_block_6 = CodeBlock { 90; }
# note: Y-axis by rotating X-axis line by 90° around Z-axis vector
rotate = Geometry.Rotate(geometry=byBestFitThroughPoints, origin=pointAtParameter, axis=reverse_2, degrees=code_block_6)
byARGB_3 = Color.ByARGB(a=code_block_4.out1, r=code_block_4.out1, g=code_block_4.out0, b=code_block_4.out1)
# note: Green Y-axis line
byGeometryColor_3 = Display.Display.ByGeometryColor(rotate, byARGB_3)
code_block_7 = CodeBlock { 2000; }
# note: Visualisation of Z-axis line
byStartPointDirectionLength = Line.ByStartPointDirectionLength(startPoint=pointAtParameter, direction=reverse_2, length=code_block_7)
byARGB_4 = Color.ByARGB(a=code_block_4.out1, r=code_block_4.out1, g=code_block_4.out1, b=code_block_4.out0)
# note: Blue Z-axis line
byGeometryColor_4 = Display.Display.ByGeometryColor(byStartPointDirectionLength, byARGB_4)
# note: X-axis vector
direction = Line.Direction(byBestFitThroughPoints)
# note: Y-axis vector
direction_2 = Line.Direction(rotate)
# note: Local XY plane
byOriginXAxisYAxis = Plane.ByOriginXAxisYAxis(pointAtParameter, direction, direction_2)
# note: Local YZ plane
byOriginXAxisYAxis_2 = Plane.ByOriginXAxisYAxis(pointAtParameter, direction_2, reverse_2)
# note: Local XZ plane
byOriginXAxisYAxis_3 = Plane.ByOriginXAxisYAxis(pointAtParameter, direction, reverse_2)

# group: Read rebar configuration from Excel
# note: Make sure you browse to the right location of your Excel file on your disk
file_path = Filename("D:\Box Sync\04 - Datasets\Dynamo\Rebar modelling\Diabolo Column Pier\Diabolo Column Rebar Configuration.xlsx")
fromPath = FileObject(file_path)  # "File.FromPath"
code_block_8 = CodeBlock { "Top Part"; }
readFromFile = Excel.ReadFromFile(file=fromPath, sheetName=code_block_8)
transpose = List.Transpose(readFromFile)
code_block_9 = CodeBlock(lst=transpose) { lst[0]; lst[1]; }
restOfItems = List.RestOfItems(code_block_9.out0)
watch = Watch(restOfItems)
restOfItems_2 = List.RestOfItems(code_block_9.out1)
code_block_10 = CodeBlock(lst=restOfItems_2)
# ---------- code_block_10.designscript (52 lines) ----------
//Material indication string
lst[0];
  //Diameter vertical longitudinal reinforcement;
lst[1];
  //Number of bars side arms outer face;
lst[2];
  //Number of bars side arms inner face;
lst[3];
  //Number of layers side arms outer face;
lst[4];
  //Number of layers side arms inner face;
lst[5];
  //Distance from outer face to center of vertical longitudinal reinforcement;
lst[6];
  //Distance from inner face to center of vertical longitudinal reinforcement;
lst[7];
  //Diameter horizontal transversal reinforcement;
lst[8];
  //Distance between horizontal transversal rebars;
lst[9];
  //Distance from face to center of horizontal transversal reinforcement;
lst[10];
  //Shift distance for hairpins rebars (= diameter horizontal transversal);
lst[11];
  //Diameter of the hairpins;
lst[12];
  //Distance between hairpins  -  NOT USED HERE;
lst[13];
  //Length of the anchor lines of the hairpins;
lst[14];
  //Distance from face to center of hairpins;
lst[15];
  //Diameter base bottom reinforcement;
lst[16];
  //Distance between bottom reinforcement bars in both directions;
lst[17];
  //Distance from face to center base bottom reinforcement lower layer;
lst[18];
  //Distance from face to center base bottom reinforcement upper layer;
lst[19];
  //Diameter base curved top reinforcement;
lst[20];
  //Distance between curved bars direction 2;
lst[21];
  //Number of straight bars direction 1;
lst[22];
  //Distance from face to center base curved top reinforcement 1st layer;
lst[23];
  //Distance from face to center base curved top reinforcement 2nd layer;
lst[24];
  //Cover to bar face;
lst[25];
# ----------------------------------------

# group: Horizontal transversal rebar lines arms outer faces (faces 3 & 4)
join = List.Join(code_block_3.out3, code_block_3.out4)
code_block_11 = CodeBlock { 1; }
code_block_12 = CodeBlock(dist_rebars=code_block_10.out9, center_distance=code_block_10.out10, num_layers=code_block_11, diameter=code_block_10.out8, cover=code_block_10.out25)
# ---------- code_block_12.designscript (5 lines) ----------
dist_rebars;
-(center_distance..#num_layers..diameter+cover);
//Set numberOfCurves to 0, but won't have influence
0;
shorten=center_distance;
# ----------------------------------------
boolean = BoolSelector(false)
boolean_2 = BoolSelector(true)
followingSurface = DynamoRebar.Rebar.FollowingSurface(arg1=code_block_12.out2, arg2=code_block_12.dist_rebars, arg3=boolean, arg4=code_block_12.out1, arg5=boolean_2, lacing=Longest)
map = List.Map(list=join, f_x=followingSurface)
code_block_13 = CodeBlock { 1; }
flatten = List.Flatten(list=map, amt=code_block_13)
split = Geometry.Split(other=code_block_3.out5)
firstItem = List.FirstItem()
map_2 = List.Map(f_x=firstItem)
split_2 = Geometry.Split(other=code_block_3.out6)
lastItem = List.LastItem()
map_3 = List.Map(f_x=lastItem)
# note: Cut the rebar lines with the outer faces (5 & 6) and keep the internal part
compose = ComposeFunctions(split, map_2, split_2, map_3)  # "Function.Compose"
map_4 = List.Map(list=flatten, f_x=compose)
code_block_14 = CodeBlock(x=code_block_12.shorten) { -x; }
# note: Shorten the rebar at both ends with a value for EACH side equal to
# "cover + d/2" (= 1 * center_distance)
extendStart = Curve.ExtendStart(curve=map_4, distance=code_block_14)
extendEnd = Curve.ExtendEnd(curve=extendStart, distance=code_block_14)

# group: Horizontal transversal rebar lines arms inner faces (faces 8 & 9)
join_2 = List.Join(code_block_3.out8, code_block_3.out9)
code_block_15 = CodeBlock { 1; }
code_block_16 = CodeBlock(dist_rebars=code_block_10.out9, center_distance=code_block_10.out10, num_layers=code_block_15, diameter=code_block_10.out8, cover=code_block_10.out25)  # same code as code_block_12
boolean_3 = BoolSelector(false)
boolean_4 = BoolSelector(true)
followingSurface_2 = DynamoRebar.Rebar.FollowingSurface(arg1=code_block_16.out2, arg2=code_block_16.dist_rebars, arg3=boolean_3, arg4=code_block_16.out1, arg5=boolean_4, lacing=Longest)
map_5 = List.Map(list=join_2, f_x=followingSurface_2)
code_block_17 = CodeBlock { 1; }
flatten_2 = List.Flatten(list=map_5, amt=code_block_17)
split_3 = Geometry.Split(other=code_block_3.out5)
lastItem_2 = List.LastItem()
map_6 = List.Map(f_x=lastItem_2)
split_4 = Geometry.Split(other=code_block_3.out6)
firstItem_2 = List.FirstItem()
map_7 = List.Map(f_x=firstItem_2)
# note: Cut the rebar lines with the outer faces (5 & 6) and keep the internal part
compose_2 = ComposeFunctions(split_3, map_6, split_4, map_7)  # "Function.Compose"
map_8 = List.Map(list=flatten_2, f_x=compose_2)
code_block_18 = CodeBlock(x=code_block_16.shorten) { -x; }
# note: Shorten the rebar at both ends with a value for EACH side equal to
# "cover + d/2" (= 1 * center_distance)
extendStart_2 = Curve.ExtendStart(curve=map_8, distance=code_block_18)
extendEnd_2 = Curve.ExtendEnd(curve=extendStart_2, distance=code_block_18)

# group: Vertical longitudinal rebar lines arms outer faces (faces 3 & 4)
join_3 = List.Join(code_block_3.out3, code_block_3.out4)
code_block_19 = CodeBlock(num_rebars=code_block_10.out2, center_distance=code_block_10.out6, num_layers=code_block_10.out4, diameter=code_block_10.out1, cover=code_block_10.out25) { num_rebars; -(center_distance..#num_layers..diameter+cover); shorten=center_distance; }
boolean_5 = BoolSelector(false)
boolean_6 = BoolSelector(false)
followingSurface_3 = DynamoRebar.Rebar.FollowingSurface(arg1=code_block_19.num_rebars, arg3=boolean_5, arg4=code_block_19.out1, arg5=boolean_6, lacing=Longest)
map_9 = List.Map(list=join_3, f_x=followingSurface_3)
code_block_20 = CodeBlock { 1; }
flatten_3 = List.Flatten(list=map_9, amt=code_block_20)
code_block_21 = CodeBlock { 40; 300; }
# note: Extend the rebar at both ends to anchor in the connecting parts
extendStart_3 = Curve.ExtendStart(curve=flatten_3, distance=code_block_21.out0)
extendEnd_3 = Curve.ExtendEnd(curve=extendStart_3, distance=code_block_21.out1)

# group: Vertical longitudinal rebar lines arms inner faces (faces 8 & 9)
join_4 = List.Join(code_block_3.out8, code_block_3.out9)
code_block_22 = CodeBlock(num_rebars=code_block_10.out3, center_distance=code_block_10.out7, num_layers=code_block_10.out5, diameter=code_block_10.out1, cover=code_block_10.out25) { num_rebars; -(center_distance..#num_layers..diameter+cover); }
boolean_7 = BoolSelector(false)
boolean_8 = BoolSelector(false)
followingSurface_4 = DynamoRebar.Rebar.FollowingSurface(arg1=code_block_22.num_rebars, arg3=boolean_7, arg4=code_block_22.out1, arg5=boolean_8, lacing=Longest)
map_10 = List.Map(list=join_4, f_x=followingSurface_4)
code_block_23 = CodeBlock { 1; }
# note: Extend the rebar at both ends to anchor in the connecting parts
flatten_4 = List.Flatten(list=map_10, amt=code_block_23)
code_block_24 = CodeBlock { 500; 800; }
extendStart_4 = Curve.ExtendStart(curve=flatten_4, distance=code_block_24.out0)
extendEnd_4 = Curve.ExtendEnd(curve=extendStart_4, distance=code_block_24.out1)

# group: Hairpins in arms
code_block_25 = CodeBlock(lst=extendEnd_3) { face3_bars=lst[0]; }
reverse_3 = List.Reverse(code_block_25)
# note: Take only the transversal rebar lines at face 3 and 8.
code_block_26 = CodeBlock(lst=extendEnd_4) { face8_bars=lst[0]; }
code_block_27 = CodeBlock(i=code_block_10.out3, o=code_block_10.out2)
# ---------- code_block_27.designscript (6 lines) ----------
//Division according to horizontal transversal bars
inner=0..1..#i+2;
outer=0..1..#o+2;
//Remove the "0" and "1" parameter value
List.RemoveItemAtIndex(inner,{0,i+1});
List.RemoveItemAtIndex(outer,{0,o+1});
# ----------------------------------------
pointAtParameter_2 = Curve.PointAtParameter(curve=code_block_26, param=code_block_27.out2, lacing=CrossProduct)
code_block_28 = CodeBlock(d_longitudinal=code_block_10.out1)
# ---------- code_block_28.designscript (3 lines) ----------
//d = diameter
d_longitudinal;
extend=d_longitudinal+5;
# ----------------------------------------
# note: Translate according local X to avoid clash with longitudinal vertical rebars
# Translate according to local Z to avoid clash with transversal horizontal rebars
translate_2 = Geometry.Translate(geometry=pointAtParameter_2, direction=direction, distance=code_block_28.d_longitudinal)
reverse_4 = Curve.Reverse(code_block_25)
pointAtParameter_3 = Curve.PointAtParameter(curve=reverse_4, param=code_block_27.out3, lacing=CrossProduct)
translate_3 = Geometry.Translate(geometry=pointAtParameter_3, direction=direction, distance=code_block_28.d_longitudinal)
byStartPointEndPoint = Line.ByStartPointEndPoint(startPoint=translate_2, endPoint=translate_3)
# note: Extend bar length for 180° hook placement around longitudinal reinforcement
extendStart_5 = Curve.ExtendStart(curve=byStartPointEndPoint, distance=code_block_28.extend)
# note: Transpose the list to get the hairpins in a group per layer (total of 19 layers)
extendEnd_5 = Curve.ExtendEnd(curve=extendStart_5, distance=code_block_28.extend)

transpose_2 = List.Transpose(extendEnd_5)

# group (continued): Hairpins in arms
# note: Mirrorplane = local XZ
mirror = Geometry.Mirror(geometry=transpose_2, mirrorPlane=byOriginXAxisYAxis_3)

# group: Creation of hairpins @ arms
id = Element.Id(select_model_element)
rebar_style = RebarStyle("StirrupTie")
code_block_29 = CodeBlock(diameter=code_block_10.out12, material=code_block_10.out0) { String.FromObject(diameter)+ " " + material; }
byName = RebarBarType.ByName(code_block_29)
rebar_hook_orientation = RebarHookOrientation("Left")
rebar_hook_orientation_2 = RebarHookOrientation("Left")
rebar_hook_type = RevitRebarHookType("Stirrup/Tie - 180 deg.")
rebar_hook_type_2 = RevitRebarHookType("Stirrup/Tie - 180 deg.")
join_5 = List.Join(transpose_2, mirror)
# note: Translate the generated reinforcement from the Dynamo orientated WCS to the Revit orientated WCS
translate_4 = Geometry.Translate(geometry=join_5, direction=asVector)
normal = Curve.Normal(translate_4)
byCurve = RebarContainer.ByCurve(arg1=id, arg2=rebar_style, arg3=byName, arg4=rebar_hook_orientation, arg5=rebar_hook_orientation_2, arg6=rebar_hook_type, arg7=rebar_hook_type_2, arg8=normal, lacing=Longest)

# group: Creation of vertical longitudinal rebars @ arms
id_2 = Element.Id(select_model_element)
rebar_style_2 = RebarStyle("Standard")
code_block_30 = CodeBlock(diameter=code_block_10.out1, material=code_block_10.out0) { String.FromObject(diameter)+ " " + material; }
byName_2 = RebarBarType.ByName(code_block_30)
rebar_hook_orientation_3 = RebarHookOrientation("Left")
rebar_hook_orientation_4 = RebarHookOrientation("Left")
rebar_hook_type_3 = RevitRebarHookType("None")
rebar_hook_type_4 = RevitRebarHookType("None")
join_6 = List.Join(extendEnd_3, extendEnd_4)
# note: Translate the generated reinforcement from the Dynamo orientated WCS to the Revit orientated WCS
translate_5 = Geometry.Translate(geometry=join_6, direction=asVector)
normal_2 = Curve.Normal(translate_5)
byCurve_2 = RebarContainer.ByCurve(arg1=id_2, arg2=rebar_style_2, arg3=byName_2, arg4=rebar_hook_orientation_3, arg5=rebar_hook_orientation_4, arg6=rebar_hook_type_3, arg7=rebar_hook_type_4, arg8=normal_2, lacing=Longest)

# group: Tangent vectors at the outer curved surface at transversal reinforcement postions
code_block_31 = CodeBlock(lst=extendEnd) { lst[0]; }
# note: Count number of transversal rebars
count = List.Count(code_block_31)
# note: As there are no rebars at the edges, 0 and 1 parameter values should be added manually to have the right division result. This is performed by i+2.
code_block_32 = CodeBlock(i=count) { 0.5; 0..1..#i+2; }
tangentAtVParameter = Surface.TangentAtVParameter(arg1=code_block_32.out0, arg2=code_block_32.out1)
map_11 = List.Map(list=join, f_x=tangentAtVParameter)
# note: Remove the first and last item as there is no reinforcement at the edges of the surface
code_block_33 = CodeBlock(i=count) { {0,i+1}; }
removeItemAtIndex = List.RemoveItemAtIndex(indices=code_block_33)
map_12 = List.Map(list=map_11, f_x=removeItemAtIndex)

# group: Creation of horizontal transversal rebars @ outer faces arms
# note: Translate the generated reinforcement from the Dynamo orientated WCS to the Revit orientated WCS
translate_6 = Geometry.Translate(direction=asVector)
join_7 = List.Join(extendEnd)
id_3 = Element.Id(select_model_element)
rebar_style_3 = RebarStyle("Standard")
code_block_34 = CodeBlock(diameter=code_block_10.out8, material=code_block_10.out0) { String.FromObject(diameter)+ " " + material; }
byName_3 = RebarBarType.ByName(code_block_34)
rebar_hook_orientation_5 = RebarHookOrientation("Left")
rebar_hook_orientation_6 = RebarHookOrientation("Left")
rebar_hook_type_5 = RevitRebarHookType("Standard - 90 deg.")
rebar_hook_type_6 = RevitRebarHookType("Standard - 90 deg.")
join_8 = List.Join(map_12)
byCurve_3 = RebarContainer.ByCurve(arg1=id_3, arg2=rebar_style_3, arg3=byName_3, arg4=rebar_hook_orientation_5, arg5=rebar_hook_orientation_6, arg6=rebar_hook_type_5, arg7=rebar_hook_type_6, arg8=join_8, lacing=Longest)

# group: Tangent vectors at the inner curved surface at transversal reinforcement postions
code_block_35 = CodeBlock(lst=extendEnd_2) { lst[0]; }
# note: Count number of transversal rebars
count_2 = List.Count(code_block_35)
# note: As there are no rebars at the edges, 0 and 1 parameter values should be added manually to have the right division result. This is performed by i+2.
code_block_36 = CodeBlock(i=count_2) { 0.5; 0..1..#i+2; }
tangentAtVParameter_2 = Surface.TangentAtVParameter(arg1=code_block_36.out0, arg2=code_block_36.out1)
map_13 = List.Map(list=join_2, f_x=tangentAtVParameter_2)
# note: Remove the firsta and last item as there is no reinforcement at the edges of the surface
code_block_37 = CodeBlock(i=count_2) { {0,i+1}; }
removeItemAtIndex_2 = List.RemoveItemAtIndex(indices=code_block_37)
map_14 = List.Map(list=map_13, f_x=removeItemAtIndex_2)

# group: Creation of horizontal transversal rebars @ inner faces arms
join_9 = List.Join(extendEnd_2)
# note: Translate the generated reinforcement from the Dynamo orientated WCS to the Revit orientated WCS
translate_7 = Geometry.Translate(geometry=join_9, direction=asVector)
id_4 = Element.Id(select_model_element)
rebar_style_4 = RebarStyle("Standard")
code_block_38 = CodeBlock(diameter=code_block_10.out8, material=code_block_10.out0) { String.FromObject(diameter)+ " " + material; }
byName_4 = RebarBarType.ByName(code_block_38)
rebar_hook_orientation_7 = RebarHookOrientation("Right")
rebar_hook_orientation_8 = RebarHookOrientation("Right")
rebar_hook_type_7 = RevitRebarHookType("Standard - 90 deg.")
rebar_hook_type_8 = RevitRebarHookType("Standard - 90 deg.")
join_10 = List.Join(map_14)
byCurve_4 = RebarContainer.ByCurve(arg1=id_4, arg2=rebar_style_4, arg3=byName_4, arg4=rebar_hook_orientation_7, arg5=rebar_hook_orientation_8, arg6=rebar_hook_type_7, arg7=rebar_hook_type_8, arg8=join_10, lacing=Longest)

# group: Bottom base rebar lines in both directions (face 2)
join_11 = List.Join(code_block_3.out2)
code_block_39 = CodeBlock(dist_rebars=code_block_10.out17, centerdistance1=code_block_10.out18, centerdistance2=code_block_10.out19)
# ---------- code_block_39.designscript (6 lines) ----------
dist_rebars;
-centerdistance1;
-centerdistance2;
//Set numberOfCurves to 0, but won't have influence
0;
shorten=centerdistance2;
# ----------------------------------------
boolean_9 = BoolSelector(true)
boolean_10 = BoolSelector(false)
followingSurface_5 = DynamoRebar.Rebar.FollowingSurface(arg1=code_block_39.out3, arg2=code_block_39.dist_rebars, arg3=boolean_9, arg4=code_block_39.out1, arg5=boolean_10, lacing=Longest)
map_15 = List.Map(list=join_11, f_x=followingSurface_5)
code_block_40 = CodeBlock { 1; }
# note: Shorten the rebar at both ends with a value for EACH side equal to
# "cover + d/2" (= 1 * center_distance)
flatten_5 = List.Flatten(list=map_15, amt=code_block_40)
code_block_41 = CodeBlock(x=code_block_39.shorten) { -x; }
extendStart_6 = Curve.ExtendStart(curve=flatten_5, distance=code_block_41)
extendEnd_6 = Curve.ExtendEnd(curve=extendStart_6, distance=code_block_41)
boolean_11 = BoolSelector(false)
boolean_12 = BoolSelector(false)
followingSurface_6 = DynamoRebar.Rebar.FollowingSurface(arg1=code_block_39.out3, arg2=code_block_39.dist_rebars, arg3=boolean_11, arg4=code_block_39.out2, arg5=boolean_12, lacing=Longest)
map_16 = List.Map(list=join_11, f_x=followingSurface_6)
code_block_42 = CodeBlock { 1; }
flatten_6 = List.Flatten(list=map_16, amt=code_block_42)
extendStart_7 = Curve.ExtendStart(curve=flatten_6, distance=code_block_41)
extendEnd_7 = Curve.ExtendEnd(curve=extendStart_7, distance=code_block_41)

# group: Creation of 1st layer rebars at support plate (bottom)
id_5 = Element.Id(select_model_element)
rebar_style_5 = RebarStyle("Standard")
code_block_43 = CodeBlock(diameter=code_block_10.out16, material=code_block_10.out0) { String.FromObject(diameter)+ " " + material; }
byName_5 = RebarBarType.ByName(code_block_43)
rebar_hook_orientation_9 = RebarHookOrientation("Right")
rebar_hook_orientation_10 = RebarHookOrientation("Right")
rebar_hook_type_9 = RevitRebarHookType("Standard - 90 deg.")
rebar_hook_type_10 = RevitRebarHookType("Standard - 90 deg.")
create = List.Create(extendEnd_6)
# note: Translate the generated reinforcement from the Dynamo orientated WCS to the Revit orientated WCS
translate_8 = Geometry.Translate(geometry=create, direction=asVector)
normal_3 = Curve.Normal(translate_8)
# note: Rotation of the normal vector around the local X-axis, in order to get the reabr hooks pointing upwards.
code_block_44 = CodeBlock { 90; }
rotate_2 = Vector.Rotate(normal_3, direction, code_block_44)
byCurve_5 = RebarContainer.ByCurve(arg1=id_5, arg2=rebar_style_5, arg3=byName_5, arg4=rebar_hook_orientation_9, arg5=rebar_hook_orientation_10, arg6=rebar_hook_type_9, arg7=rebar_hook_type_10, arg8=rotate_2, lacing=Longest)

# group: Rebar lines at curved inner face (face 7)
join_12 = List.Join(code_block_3.out7)
code_block_45 = CodeBlock(num_rebars_dir1=code_block_10.out22, dist_rebars_dir2=code_block_10.out21, centerdistance1=code_block_10.out23, centerdistance2=code_block_10.out24)
# ---------- code_block_45.designscript (7 lines) ----------
num_rebars_dir1;
dist_rebars_dir2;
-centerdistance1;
-centerdistance2;
//Set numberOfCurves to 0, but won't have influence
0;
shorten=centerdistance2;
# ----------------------------------------
boolean_13 = BoolSelector(false)
boolean_14 = BoolSelector(true)
followingSurface_7 = DynamoRebar.Rebar.FollowingSurface(arg1=code_block_45.num_rebars_dir1, arg3=boolean_13, arg4=code_block_45.out2, arg5=boolean_14, lacing=Longest)
map_17 = List.Map(list=join_12, f_x=followingSurface_7)
code_block_46 = CodeBlock { 1; }
flatten_7 = List.Flatten(list=map_17, amt=code_block_46)
code_block_47 = CodeBlock(x=code_block_45.shorten) { -x; }
# note: Shorten the rebar at both ends with a value for EACH side equal to
# "cover + d/2" (= 1 * center_distance)
extendStart_8 = Curve.ExtendStart(curve=flatten_7, distance=code_block_47)
extendEnd_8 = Curve.ExtendEnd(curve=extendStart_8, distance=code_block_47)
boolean_15 = BoolSelector(false)
boolean_16 = BoolSelector(false)
followingSurface_8 = DynamoRebar.Rebar.FollowingSurface(arg1=code_block_45.out4, arg2=code_block_45.dist_rebars_dir2, arg3=boolean_15, arg4=code_block_45.out3, arg5=boolean_16, lacing=Longest)
map_18 = List.Map(list=join_12, f_x=followingSurface_8)
code_block_48 = CodeBlock { 1; }
flatten_8 = List.Flatten(list=map_18, amt=code_block_48)

# group: Creation of 1st layer rebars at support plate (top)
id_6 = Element.Id(select_model_element)
rebar_style_6 = RebarStyle("Standard")
code_block_49 = CodeBlock(diameter=code_block_10.out16, material=code_block_10.out0) { String.FromObject(diameter)+ " " + material; }
byName_6 = RebarBarType.ByName(code_block_49)
rebar_hook_orientation_11 = RebarHookOrientation("Right")
rebar_hook_orientation_12 = RebarHookOrientation("Right")
rebar_hook_type_11 = RevitRebarHookType("Standard - 90 deg.")
rebar_hook_type_12 = RevitRebarHookType("Standard - 90 deg.")
create_2 = List.Create(extendEnd_8)
# note: Translate the generated reinforcement from the Dynamo orientated WCS to the Revit orientated WCS
translate_9 = Geometry.Translate(geometry=create_2, direction=asVector)
normal_4 = Curve.Normal(translate_9)
byCurve_6 = RebarContainer.ByCurve(arg1=id_6, arg2=rebar_style_6, arg3=byName_6, arg4=rebar_hook_orientation_11, arg5=rebar_hook_orientation_12, arg6=rebar_hook_type_11, arg7=rebar_hook_type_12, arg8=normal_4, lacing=Longest)

# group: Creation of 2nd layer rebars at bottom support face
id_7 = Element.Id(select_model_element)
rebar_style_7 = RebarStyle("Standard")
code_block_50 = CodeBlock(diameter=code_block_10.out16, material=code_block_10.out0) { String.FromObject(diameter)+ " " + material; }
byName_7 = RebarBarType.ByName(code_block_50)
rebar_hook_orientation_13 = RebarHookOrientation("Left")
rebar_hook_orientation_14 = RebarHookOrientation("Left")
rebar_hook_type_13 = RevitRebarHookType("None")
rebar_hook_type_14 = RevitRebarHookType("None")
create_3 = List.Create(extendEnd_7, flatten_8)
# note: Translate the generated reinforcement from the Dynamo orientated WCS to the Revit orientated WCS
translate_10 = Geometry.Translate(geometry=create_3, direction=asVector)
normal_5 = Curve.Normal(translate_10)
byCurve_7 = RebarContainer.ByCurve(arg1=id_7, arg2=rebar_style_7, arg3=byName_7, arg4=rebar_hook_orientation_13, arg5=rebar_hook_orientation_14, arg6=rebar_hook_type_13, arg7=rebar_hook_type_14, arg8=normal_5, lacing=Longest)

# group: View representation of Rebars
views = Views("Column - Formwork &amp; Rebar")
views_2 = Views("Column - Bottom Part")
views_3 = Views("Column - Top Part")
views_4 = Views("Column - Rebar")
views_5 = Views("Column - Half Section 1")
views_6 = Views("Column - Half Section 2")
create_4 = List.Create(views, views_2, views_3, views_4, views_5, views_6)
boolean_17 = BoolSelector(true)
setSolidInView = RebarContainer.SetSolidInView(byCurve, arg2=boolean_17, lacing=Longest)
map_19 = List.Map(list=create_4, f_x=setSolidInView)
setSolidInView_2 = RebarContainer.SetSolidInView(byCurve_2, arg2=boolean_17, lacing=Longest)
map_20 = List.Map(list=create_4, f_x=setSolidInView_2)
setSolidInView_3 = RebarContainer.SetSolidInView(byCurve_3, arg2=boolean_17, lacing=Longest)
map_21 = List.Map(list=create_4, f_x=setSolidInView_3)
setSolidInView_4 = RebarContainer.SetSolidInView(byCurve_4, arg2=boolean_17, lacing=Longest)
map_22 = List.Map(list=create_4, f_x=setSolidInView_4)
setSolidInView_5 = RebarContainer.SetSolidInView(byCurve_5, arg2=boolean_17, lacing=Longest)
map_23 = List.Map(list=create_4, f_x=setSolidInView_5)
setSolidInView_6 = RebarContainer.SetSolidInView(byCurve_6, arg2=boolean_17, lacing=Longest)
map_24 = List.Map(list=create_4, f_x=setSolidInView_6)
setSolidInView_7 = RebarContainer.SetSolidInView(byCurve_7, arg2=boolean_17, lacing=Longest)
map_25 = List.Map(list=create_4, f_x=setSolidInView_7)
