# Dynamo graph ENGINE_SPLINE_FINAL.dyn (Dynamo 0.7.5.3272)

select_model_element = DSModelElementSelection()
select_model_element_2 = DSModelElementSelection()
select_model_element_3 = DSModelElementSelection()
create_list = List.Create(select_model_element, select_model_element_2, select_model_element_3)
byLoftCrossSections = Form.ByLoftCrossSections(create_list)
geometry = Element.Geometry(byLoftCrossSections)
