# Dynamo graph GIS EXMAPLE infrabimgis.dyn (Dynamo 0.9.1.4062)

# group: Read the Shape File and process the data into List
file_path = Filename("C:\Users\harrisond\Documents\Dynamo_example.shp")
loadFromFile = EGIS.DynamoLib.Shape.LoadFromFile(file_path)
# note: Get the number in the Shape file
recordCount = EGIS.DynamoLib.Shape.RecordCount(loadFromFile)
code_block = CodeBlock { 1; }
sub = recordCount - code_block
# note: 12 is the number of point in the shape file. Refer Shape.REconrd Count
code_block_2 = CodeBlock { 0..11; }
getAllPoints = EGIS.DynamoLib.Shape.GetAllPoints(loadFromFile, code_block_2)
flatten = Flatten(getAllPoints)
X = Vector.X(flatten)
Y = Vector.Y(flatten)
Z = Vector.Z(flatten)

# group: Custom Node - Coordiantes
transfrom_Revit_in = Custom[Transfrom_Revit_in](Input_X=X, Input_Y=Y, Input_Z=Z)  # Transform Real world coordinates using Revit Base Point to matrix transform points

# group: Insert Revit Point Family
family_types = FamilyTypes("Rectangular Column (AUS):457 x 475mm")
byCoordinates = Point.ByCoordinates(x=transfrom_Revit_in.transform_X, y=transfrom_Revit_in.transform_Y, z=transfrom_Revit_in.transform_Z)
byPoint = FamilyInstance.ByPoint(familyType=family_types, point=byCoordinates)
