# Dynamo graph LandXML_Surface_Web.dyn (Dynamo 0.9.0.3067)

file_path = Filename("No file selected.")
fromPath = FileObject(file_path)  # "File.FromPath"
readText = File.ReadText(fromPath)
code_block = CodeBlock()
# ---------- code_block.designscript (2 lines) ----------
//Points
"P";
# ----------------------------------------

# group: Extracting XYZ
getXMLNode = Lists.DataSets.GetXMLNode(readText, code_block)
flatten = Flatten(getXMLNode)
code_block_2 = CodeBlock { " "; }
split = String.Split(flatten, code_block_2)
toNumber = String.ToNumber(split)
transpose = List.Transpose(toNumber)
code_block_3 = CodeBlock(a=transpose) { a[0]; a[1]; a[2]; }

# group: Converting to local basepoint
code_block_4 = CodeBlock { {6641500,586000}; }
code_block_5 = CodeBlock(x=code_block_3.out0, PB0=code_block_4, y=code_block_3.out1, z=code_block_3.out2) { x-PB0[0]; y-PB0[1]; z; }

byCoordinates = Point.ByCoordinates(x=code_block_5.out0, y=code_block_5.out1, z=code_block_5.z)

# group: Creating Dynamo Index Groups
code_block_6 = CodeBlock()
# ---------- code_block_6.designscript (2 lines) ----------
//Faceindices
"F";
# ----------------------------------------
getXMLNode_2 = Lists.DataSets.GetXMLNode(readText, code_block_6)
flatten_2 = Flatten(getXMLNode_2)
code_block_7 = CodeBlock { " "; }
split_2 = String.Split(flatten_2, code_block_7)
toNumber_2 = String.ToNumber(split_2)
code_block_8 = CodeBlock(x=toNumber_2) { x-1; }
transpose_2 = List.Transpose(code_block_8)
code_block_9 = CodeBlock(a=transpose_2) { a[0]; a[1]; a[2]; }
byIndices = IndexGroup.ByIndices(code_block_9.out0, code_block_9.out1, code_block_9.out2)

# group: Getting Chop Lengths
code_block_10 = CodeBlock { "Pnts"; }
# note: Lunchbox
getXMLNode_3 = Lists.DataSets.GetXMLNode(readText, code_block_10)
code_block_11 = CodeBlock(str=getXMLNode_3) { Pnts=String.CountOccurrences(str<1>,"<P id=",false); }
code_block_12 = CodeBlock { "Faces"; }
getXMLNode_4 = Lists.DataSets.GetXMLNode(readText, code_block_12)
code_block_13 = CodeBlock(str=getXMLNode_4) { Fcs=String.CountOccurrences(str<1>,"<F",false); }

# note: spring nodes
dropLast = Custom[List.DropLast](list=code_block_11)  # Removes the last value of the list.

# group (continued): Getting Chop Lengths
chop = List.Chop(byCoordinates, dropLast)

dropLast_2 = Custom[List.DropLast](list=code_block_13)

# group (continued): Getting Chop Lengths
chop_2 = List.Chop(byIndices, dropLast_2)

# group: Extracting surface names
python_script = Python(IN[0]=readText)
# ---------- python_script.python (6 lines) ----------
import re
#The inputs to this node will be stored as a list in the IN variables.
dataEnteringNode = IN
My_str=IN[0]
#Assign your output to the OUT variable.
OUT = re.compile("<Surface name=\"(.*?)\">", re.DOTALL).findall(My_str)
# ----------------------------------------
# note: spring nodes
dropLast_3 = Custom[List.DropLast](list=python_script)
code_block_14 = CodeBlock(x=dropLast_3) { x; }

# group: Output
byPointsFaceIndices = Mesh.ByPointsFaceIndices(chop, chop_2)
categories = Categories("GenericModel")
code_block_15 = CodeBlock { "Site - Gress"; }
byName = Material.ByName(code_block_15)
byMesh = DirectShape.ByMesh(byPointsFaceIndices, categories, byName, code_block_14)
