# Dynamo graph OSMtoRevit.dyn (Dynamo 1.2.0.2831)

file_path = Filename("C:\Users\PowerUser\Downloads\53.3237,6.9405-53.2984,7.0075.osm")
location = Elk.OSM.Location(file_path)
code_block = CodeBlock { "highway"; "*"; }
OSMData = Elk.OSM.OSMData(location.out0, location.out1, code_block.out0, code_block.out1)
byPoints = PolyCurve.ByPoints(points=OSMData)
code_block_2 = CodeBlock { "railway"; "*"; }
OSMData_2 = Elk.OSM.OSMData(location.out0, location.out1, code_block_2.out0, code_block_2.out1)
byPoints_2 = PolyCurve.ByPoints(points=OSMData_2)
code_block_3 = CodeBlock { "building"; "*"; }
OSMData_3 = Elk.OSM.OSMData(location.out0, location.out1, code_block_3.out0, code_block_3.out1)
byPoints_3 = PolyCurve.ByPoints(points=OSMData_3)
watch = Watch(OSMData_3)
