# Dynamo graph Phase_Created.dyn (Dynamo 1.2.0.2831)

element_types = ElementTypes("Wall")
all_elements_of_type = ElementsOfType(element_types)
code_block = CodeBlock { "Phase Created"; }
getParameterValueByName = Element.GetParameterValueByName(element=all_elements_of_type, parameterName=code_block)
firstItem = List.FirstItem(getParameterValueByName)
setParameterByName = Element.SetParameterByName(element=all_elements_of_type, parameterName=code_block, value=firstItem)
