# Dynamo graph ROOM_TO_FLOOR_FINAL.dyn (Dynamo 0.7.4.3163)

categories = Categories("Rooms")
all_elements_of_category = ElementsOfCategory(categories)
geometry = Element.Geometry(all_elements_of_category)
XY = Plane.XY()
intersect = Geometry.Intersect(geometry, XY)
perimeterCurves = Surface.PerimeterCurves(intersect)
code_block = CodeBlock { 2; }
flatten = List.Flatten(perimeterCurves, code_block)
string = StringInput("Floor Finish")
getParameterValueByName = Element.GetParameterValueByName(all_elements_of_category, string)
byName = FloorType.ByName(getParameterValueByName)
levels = Levels("01 - Entry Level")
byOutlineTypeAndLevel = Floor.ByOutlineTypeAndLevel(flatten, byName, levels)
