# Dynamo graph ROOM_TO_FLOOR_FINAL_WITH_THICKNESS.dyn (Dynamo 0.7.4.3245)

categories = Categories("Rooms")
all_elements_of_category = ElementsOfCategory(categories)
geometry = Element.Geometry(all_elements_of_category)
XY = Plane.XY()
intersect = Geometry.Intersect(geometry, XY)
perimeterCurves = Surface.PerimeterCurves(intersect)
number = DoubleInput(2)
flatten = List.Flatten(perimeterCurves, number)
string = StringInput("Floor Finish")
getParameterValueByName = Element.GetParameterValueByName(all_elements_of_category, string)
byName = FloorType.ByName(getParameterValueByName)
levels = Levels("01 - Entry Level")
byOutlineTypeAndLevel = Floor.ByOutlineTypeAndLevel(flatten, byName, levels)
string_2 = StringInput("Height Offset From Level")
string_3 = StringInput("Thickness")
getParameterValueByName_2 = Element.GetParameterValueByName(byOutlineTypeAndLevel, string_3)
setParameterByName = Element.SetParameterByName(byOutlineTypeAndLevel, string_2, getParameterValueByName_2)
