# Dynamo graph ROOM_TO_FLOOR_MID.dyn (Dynamo 0.7.4.3163)

categories = Categories("Rooms")
all_elements_of_category = ElementsOfCategory(categories)
geometry = Element.Geometry(all_elements_of_category)
XY = Plane.XY()
intersect = Geometry.Intersect(geometry, XY)
perimeterCurves = Surface.PerimeterCurves(intersect)
