# Dynamo graph Rebaronfacev.0.dyn (Dynamo 0.7.0.36985)

select_vertical_rebars_sf = StructuralFramingSelector(index=2)
h_number_or_hor_rebars = DoubleInput(20)
number = DoubleInput(1)
add = Addition(h_number_or_hor_rebars, number, lacing=Longest)
# note: Select face to host Rebars
select_face = FormElementBySelection()  # 1 picked in the model
v_number_of_vert_rebars = DoubleInput(50)
uv_xyz_grid_from_face = Custom[UV/XYZ Grid From Face](face=select_face, U=v_number_of_vert_rebars, V=h_number_or_hor_rebars)  # Returns UV coordinates, XYZ coordinates and normals for a face with UV subdivision
number_2 = DoubleInput(2)
add_2 = Addition(h_number_or_hor_rebars, number_2, lacing=Longest)
drop_every_nth = RemoveEveryNth(add, uv_xyz_grid_from_face.UVs, add_2)
flatten_completely = FlattenList(drop_every_nth)
number_3 = DoubleInput(0)
drop_every_nth_2 = RemoveEveryNth(h_number_or_hor_rebars, flatten_completely, number_3)
list_length = Length(drop_every_nth_2)
number_4 = DoubleInput(1)
subtract = Subtraction(h_number_or_hor_rebars, number_4, lacing=Longest)
subtract_2 = Subtraction(list_length, subtract, lacing=Longest)
take_from_list = TakeList(subtract_2, drop_every_nth_2)
# note: Grid without borders
evaluate_uv = XyzEvaluate(take_from_list, select_face, lacing=Longest)
n1 = Custom[-1](h_number_or_hor_rebars)  # Decrements a value by 1
partition_list = Slice(evaluate_uv, n1)
hermite_spline = HermiteSpline(partition_list, lacing=Longest)
evaluate_normal = NormalEvaluate(take_from_list, select_face, lacing=Longest)
number_5 = DoubleInput(0)
take_every_nth = TakeEveryNth(n1, evaluate_normal, number_5)
vert_rebars = StructuralFraming(select_vertical_rebars_sf, hermite_spline, take_every_nth)
select_horizontal_rebars_sf = StructuralFramingSelector(index=0)
transpose_lists = Transpose(partition_list)
hermite_spline_2 = HermiteSpline(transpose_lists, lacing=Longest)
y_axis = XyzBasisY(lacing=Longest)
list_length_2 = Length(hermite_spline_2)
repeat = Repeat(y_axis, list_length_2, lacing=Longest)
hor_rebars = StructuralFraming(select_horizontal_rebars_sf, hermite_spline_2, repeat)
