# Dynamo graph SetCommentsByElementType.dyn (Dynamo 1.2.0.2831)

element_types = ElementTypes("Wall")
all_elements_of_type = ElementsOfType(element_types)
code_block = CodeBlock { "Comments"; }
code_block_2 = CodeBlock { "Sample text"; }
setParameterByName = Element.SetParameterByName(element=all_elements_of_type, parameterName=code_block, value=code_block_2)
