# Dynamo graph TOPO_from_excel_FINAL.dyn (Dynamo 0.7.5.3272)

file_path = Filename("E:\BACKUP\Personal\Presentation\Presentation_14_12_03_AUTODESK_UNIVERSITY_2014\01_DYNAMO LECTURE\EXERSIZES\EX_06_TOPO\TOPO.xlsx")
fromPath = FileObject(file_path)  # "File.FromPath"
string = StringInput("Sheet1")
readFromFile = Excel.ReadFromFile(fromPath, string)
number = DoubleInput(0)
getItemAtIndex = List.GetItemAtIndex(readFromFile, number)
number_2 = DoubleInput(1)
getItemAtIndex_2 = List.GetItemAtIndex(readFromFile, number_2)
number_3 = DoubleInput(2)
getItemAtIndex_3 = List.GetItemAtIndex(readFromFile, number_3)
byCoordinates = Point.ByCoordinates(getItemAtIndex, getItemAtIndex_2, getItemAtIndex_3, lacing=Longest)
byPoints = Topography.ByPoints(byCoordinates)
