# Dynamo graph TOPO_from_excel_OUT.dyn (Dynamo 0.7.5.3272)

file_path = Filename("E:\BACKUP\Personal\Presentation\Presentation_14_12_03_AUTODESK_UNIVERSITY_2014\01_DYNAMO LECTURE\EXERSIZES\EX_06_TOPO\TOPO.xlsx")
code_block = CodeBlock { "Sheet1"; }
code_block_2 = CodeBlock { 0; }
code_block_3 = CodeBlock { 0; }
select_model_element = DSModelElementSelection()  # 1 picked in the model
points = Topography.Points(select_model_element)
X = Point.X(points)
Z = Point.Z(points)
Y = Point.Y(points)
create = List.Create(X, Z, Y)
writeToFile = Excel.WriteToFile(file_path, code_block, code_block_2, code_block_3, create)
