# Dynamo graph Toggle_rebar.dyn (Dynamo 1.2.0.2831)

element_types = ElementTypes("Wall")
all_elements_of_type = ElementsOfType(element_types)
current = Document.Current()
activeView = Document.ActiveView(current)
number = DoubleInput(50)
overrideTransparencyInView = Custom[Element.OverrideTransparencyInView](element=all_elements_of_type, view=activeView, transparencyPercentage=number)  # Overrides the transparency of an element in a given view
