# Dynamo graph Update Sheet Names to Upper Case.dyn (Dynamo 1.2.0.2566)

element_types = ElementTypes("ViewSheet")
all_elements_of_type = ElementsOfType(element_types)
code_block = CodeBlock { "Sheet Name"; }
getParameterValueByName = Element.GetParameterValueByName(element=all_elements_of_type, parameterName=code_block)
toUpper = String.ToUpper(getParameterValueByName)
setParameterByName = Element.SetParameterByName(element=all_elements_of_type, parameterName=code_block, value=toUpper)
