# Dynamo graph dynamosat.dyn (Dynamo 0.8.1.1942)

code_block = CodeBlock { Point.ByCoordinates(0,0,0); }
ZAxis = Vector.ZAxis()
byOriginNormal = Plane.ByOriginNormal(origin=code_block, normal=ZAxis)
number_slider = DoubleSlider(7, range=1..20 step 1)
code_block_2 = CodeBlock(nb=number_slider) { 1..44.9..#nb; }
offset = Plane.Offset(byOriginNormal, code_block_2)
file_path = Filename("D:\3 - Efface\Dynamo Sat\Feuille.sat")
importFromSAT = Geometry.ImportFromSAT(file_path)
byJoinedSurfaces = PolySurface.ByJoinedSurfaces(importFromSAT)
intersectAll = Geometry.IntersectAll(geometry=offset, others=byJoinedSurfaces)
levels = Levels("Fondations")
structural_framing_types = StructuralFramingTypes("20x40")
beamByCurve = StructuralFraming.BeamByCurve(intersectAll, levels, structural_framing_types)
