# Dynamo graph exportexample.dyn (Dynamo 0.7.5.3272)

boolean = BoolSelector(true)
code_block = CodeBlock { 10; }
byLengths = Cuboid.ByLengths(code_block, code_block, code_block)
code_block_2 = CodeBlock { 15; }
byWidthHeight = Rectangle.ByWidthHeight(code_block_2, code_block_2)
create = List.Create(byLengths, byWidthHeight)
code_block_3 = CodeBlock { null; }
if_ = If(boolean, create, code_block_3)
code_block_4 = CodeBlock { 0; }
getItemAtIndex = List.GetItemAtIndex(if_, code_block_4)
byGeometries = ImportInstance.ByGeometries(getItemAtIndex)
watch = Watch(byGeometries)
code_block_5 = CodeBlock { 1; }
getItemAtIndex_2 = List.GetItemAtIndex(if_, code_block_5)
curves = PolyCurve.Curves(getItemAtIndex_2)
byCurve = ModelCurve.ByCurve(curves)
watch_2 = Watch(byCurve)
