# Dynamo graph miseenplan.dyn (Dynamo 0.9.0.3067)

string = StringInput("VillageBIM")
get_all_views = Custom[Get All Views]()  # This node will query all views in the model and return them based on category
create = List.Create(get_all_views.Sections, get_all_views.3D_Views)
count = List.Count(create)
code_block = CodeBlock(n=count) { 1..n; }
string_from_object = FromObject(code_block)
family_types = FamilyTypes("Cartouche avec révisions:A0")
byNameNumberTitleBlockAndViews = Sheet.ByNameNumberTitleBlockAndViews(string, string_from_object, family_types, create)
