# Dynamo graph sketch_final.dyn (Dynamo 0.7.5.3213)

code_block = CodeBlock { {"1","2"}; }
code_block_2 = CodeBlock { {"1","2"}; }
family_types = FamilyTypes("Ssk 11x17:Ssk 11x17")
select_model_elements = DSModelElementsSelection()  # 2 picked in the model
geometry = Element.Geometry(select_model_elements)
byGeometry = BoundingBox.ByGeometry(geometry)
byBoundingBox = SectionView.ByBoundingBox(byGeometry)
byNameNumberTitleBlockAndView = Sheet.ByNameNumberTitleBlockAndView(code_block, code_block_2, family_types, byBoundingBox)
